# Grasshopper definition Variable Wall Geometry.gh (Grasshopper 1.0.8)

extrcrv = ExtrudeAlong(Base=<curve referenced from the Rhino model>, Curve=<geometry referenced from the Rhino model>)
vec = VectorXYZ(
    XComponent=Slider(-100, range=-100..100),
    YComponent=Slider(-41, range=-100..100),
    ZComponent=Slider(-13, range=-100..100))  # -> Vector, Length
extrcrv_2 = ExtrudeAlong(Base=<curve referenced from the Rhino model>, Curve=<geometry referenced from the Rhino model>)

# ---- group: scan1
mesh = Mesh(<mesh referenced from the Rhino model>)

# ----
move = Move(Geometry=extrcrv, Motion=vec.Vector)  # -> Geometry, Transform
swatch = ColourSwatch(SwatchColor=RGB(255, 255, 255))
swatch_2 = ColourSwatch(SwatchColor=RGB(255, 255, 255))
swp2 = Sweep2(Rail1=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, Rail2=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, Sections=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, SameHeight=False)

# ---- group: Test Geometries for meshing
# Recommended average length over 8 mm
number_slider = Slider(10, range=0..10)
subd = SubD(<subd referenced from the Rhino model>)
srf = Surface(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)
triremesh = TriRemesh(Geometry=swp2, Length=number_slider, Iterations=15)  # -> Triangulation, Dual, Creases
mjoin = MeshJoin(Meshes=triremesh.Triangulation)

# ----
scan_mesh_tutorial = Mesh(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)

# ---- group: Variable width
width_range = ConstructDomain(DomainStart="10", DomainEnd="36")
overlap = Number(Slider(6, range=0..10))

# ---- group: Candidate Generation Options
number_slider_2 = Slider(4, range=0..40)
list = ValueList({"gradient_lift", "z_lift"}, selected="gradient_lift")
number_slider_3 = Slider(5, range=0..10)
number_slider_4 = Slider(11, range=10..20)

# ---- group: Orient Target to Clamping Cone
toggle = BooleanToggle(True)
number_slider_5 = Slider(35, range=0..100)

# ---- group: Fixed width
width = Slider(33, range=12..50)
number_slider_6 = Slider(21, range=0..100)

# ----
split = SplitBrep(Brep=extrcrv_2, Cutter=move.Geometry)

# ---- group: Input Meshes
goal_mesh = Mesh(mjoin)
scan_mesh = Mesh(scan_mesh_tutorial)

# ----
loft = Loft(
    Curves=[<geometry referenced from the Rhino model> x2],
    Options={Adjust=False, Closed=False, LoftEnds=0, LoftSimp=0, LoftType=0, Rebuild=10, Refit=0.01})
split_2 = SplitList(List=split, Index=1)  # -> ListA, ListB
preview = CustomPreview(Geometry=swp2, Material=ColourSwatch(SwatchColor=RGB(21, 0, 107)))
medges = MeshEdges(Mesh=goal_mesh)  # -> NakedEdges, InteriorEdges, NonManifoldEdges
preview_2 = CustomPreview(Geometry=split_2.ListA, Material=ColourSwatch(SwatchColor=RGB(0, 255, 128)))
preview_3 = CustomPreview(Geometry=loft, Material=ColourSwatch(SwatchColor=RGB(21, 0, 107)))

# ---- group: Seed vertices by lowest Z
# D1 is for the index of the seed vertex
# D2 is the corresponding heat initial value
demesh = DeconstructMesh(Mesh=goal_mesh)  # -> Vertices, Faces, Colours, Normals
pdecon = Deconstruct(Point=demesh.Vertices)  # -> XComponent, YComponent, ZComponent
sort = SortList(Keys=pdecon.ZComponent)  # -> Keys, ValuesA
item = ListItem(List=sort.Keys, Index=0, Wrap=True)
addition = Addition(A=item, B=Slider(2, range=0..10))
smaller = SmallerThan(FirstNumber=pdecon.ZComponent, SecondNumber=addition)  # -> SmallerThan, OrEqualTo
cull = CullPattern(List=demesh.Vertices, CullPattern=smaller.SmallerThan)
mindex = MemberIndex(Set=demesh.Vertices, Member=cull)  # -> flatten(Index), Count
seed_vertices = Point(cull)
lng = ListLength(List=mindex.Index)
repeat = RepeatData(Data="1", Length=lng)
merge = Merge(Data1=simplify(graft(mindex.Index)), Data2=simplify(graft(repeat)))  # -> simplify(flatten(Result))

# ----
imported_seeds = Number([0, 0, 1, 0, 2, 0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])

vectorheatmethod = Python3Script(mesh=goal_mesh, seed_data=flatten(merge), t_coef=Slider(2000, range=0..2000))  # -> out, points, field, normalized_field, seed_indices, seed_values, seed_points, info; inputs mesh: Mesh, seed_data: list of Double, t_coef: Double
# ---------- vectorheatmethod: Python ----------
# venv: heatmethod
# requirements: numpy, scipy, potpourri3d

"""
Weighted scalar heat diffusion for Grasshopper.

Inputs
------
mesh : Rhino.Geometry.Mesh
    Triangle or quad mesh. Quads are split into triangles.

seed_data : list
    Alternating vertex index and initial scalar value:

        index, value, index, value, ...

    Example:

        0
        0.771094
        1
        0.404163
        2
        0.165999
        3
        0.985047

    Every vertex not explicitly listed receives u0 = 0.

t_coef : float
    Diffusion coefficient relative to mean mesh edge length.

    t = mean_edge_length^2 * t_coef

    Suggested initial values:
        0.0   -> no diffusion before polarity conversion
        0.1   -> very local diffusion
        1.0   -> moderate diffusion
        5.0   -> stronger diffusion
        20.0  -> broad smoothing

Outputs
-------
points : list[Rhino.Geometry.Point3d]
    Mesh vertices in their original order.

field : list[float]
    Diffused scalar field with distance-like polarity.

    Low values are near the weighted seeds.
    High values are away from the weighted seeds.

    The original numeric range of the diffusion result
    is preserved.

normalized_field : list[float]
    Normalized version of field in the range [0, 1].

    Low values are near the weighted seeds.
    High values are away from the weighted seeds.

    This follows the convention expected by candidate
    selection and gradient_lift.

u0 : list[float]
    Original diffusion excitation before solving and before
    polarity inversion.

seed_indices : list[int]
    Parsed seed indices.

seed_values : list[float]
    Initial scalar values assigned to the seeds.

seed_points : list[Rhino.Geometry.Point3d]
    Locations of the seed vertices.

mean_edge_length : float
    Mean unique edge length.

diffusion_time : float
    Actual diffusion time t.

field_min : float
    Minimum value of the final distance-like field.

field_max : float
    Maximum value of the final distance-like field.

info : str
    Diagnostic summary.
"""

import Rhino.Geometry as rg
import numpy as np
import potpourri3d as pp3d

from scipy.sparse import diags
from scipy.sparse.linalg import spsolve


# ============================================================
# RHINO MESH -> NUMPY ARRAYS
# ============================================================

def rhino_mesh_to_arrays(rhino_mesh):

    if rhino_mesh is None:
        raise ValueError(
            "No mesh was provided."
        )

    if rhino_mesh.Vertices.Count == 0:
        raise ValueError(
            "The mesh has no vertices."
        )

    if rhino_mesh.Faces.Count == 0:
        raise ValueError(
            "The mesh has no faces."
        )

    vertices = np.array(
        [
            [
                float(vertex.X),
                float(vertex.Y),
                float(vertex.Z)
            ]
            for vertex in rhino_mesh.Vertices
        ],
        dtype=np.float64
    )

    triangle_faces = []

    for face in rhino_mesh.Faces:

        if face.IsTriangle:

            triangle_faces.append(
                [
                    int(face.A),
                    int(face.B),
                    int(face.C)
                ]
            )

        else:

            # Split quad A-B-C-D into:
            #
            # A-B-C
            # A-C-D

            triangle_faces.append(
                [
                    int(face.A),
                    int(face.B),
                    int(face.C)
                ]
            )

            triangle_faces.append(
                [
                    int(face.A),
                    int(face.C),
                    int(face.D)
                ]
            )

    faces = np.asarray(
        triangle_faces,
        dtype=np.int64
    )

    return vertices, faces


# ============================================================
# PARSE ALTERNATING INDEX/VALUE SEED INPUT
# ============================================================

def parse_seed_data(data, vertex_count):

    if data is None:
        raise ValueError(
            "seed_data is empty."
        )

    raw_data = list(data)

    if len(raw_data) == 0:
        raise ValueError(
            "seed_data must contain at least one "
            "index/value pair."
        )

    if len(raw_data) % 2 != 0:
        raise ValueError(
            "seed_data must alternate:\n"
            "index, scalar, index, scalar, ..."
        )

    # Repeated indices are allowed.
    # The last supplied value wins.
    scalar_by_index = {}

    for position in range(
        0,
        len(raw_data),
        2
    ):

        raw_index = raw_data[position]
        raw_value = raw_data[position + 1]

        try:

            vertex_index = int(
                raw_index
            )

        except Exception:

            raise ValueError(
                "Could not convert seed_data item {} "
                "to a vertex index: {}".format(
                    position,
                    raw_index
                )
            )

        try:

            scalar_value = float(
                raw_value
            )

        except Exception:

            raise ValueError(
                "Could not convert seed_data item {} "
                "to a scalar value: {}".format(
                    position + 1,
                    raw_value
                )
            )

        if (
            vertex_index < 0
            or vertex_index >= vertex_count
        ):

            raise ValueError(
                "Seed index {} is outside the valid "
                "range 0 to {}.".format(
                    vertex_index,
                    vertex_count - 1
                )
            )

        if not np.isfinite(
            scalar_value
        ):

            raise ValueError(
                "Seed value at vertex {} is not "
                "finite.".format(
                    vertex_index
                )
            )

        scalar_by_index[
            vertex_index
        ] = scalar_value

    indices = list(
        scalar_by_index.keys()
    )

    values = [
        scalar_by_index[index]
        for index in indices
    ]

    return indices, values


# ============================================================
# UNIQUE MESH EDGES AND MEAN EDGE LENGTH
# ============================================================

def compute_mean_edge_length(
    vertices,
    faces
):

    edge_set = set()

    for face in faces:

        i = int(face[0])
        j = int(face[1])
        k = int(face[2])

        face_edges = (
            (i, j),
            (j, k),
            (k, i)
        )

        for a, b in face_edges:

            # Store each edge only once.
            if a < b:

                edge_set.add(
                    (a, b)
                )

            else:

                edge_set.add(
                    (b, a)
                )

    if len(edge_set) == 0:

        raise ValueError(
            "No valid mesh edges were found."
        )

    edge_array = np.asarray(
        list(edge_set),
        dtype=np.int64
    )

    edge_vectors = (
        vertices[edge_array[:, 0]]
        - vertices[edge_array[:, 1]]
    )

    edge_lengths = np.linalg.norm(
        edge_vectors,
        axis=1
    )

    valid_lengths = edge_lengths[
        edge_lengths > 1e-12
    ]

    if valid_lengths.size == 0:

        raise ValueError(
            "All mesh edges have zero length."
        )

    return float(
        np.mean(valid_lengths)
    )


# ============================================================
# NORMALIZE SCALAR FIELD
# ============================================================

def normalize_scalar_field(values):

    values = np.asarray(
        values,
        dtype=np.float64
    )

    finite = np.isfinite(
        values
    )

    if not np.any(finite):

        raise ValueError(
            "The scalar field contains no finite values."
        )

    minimum = float(
        np.min(
            values[finite]
        )
    )

    maximum = float(
        np.max(
            values[finite]
        )
    )

    scalar_range = (
        maximum
        - minimum
    )

    normalized = np.zeros_like(
        values,
        dtype=np.float64
    )

    if scalar_range > 1e-12:

        normalized[finite] = (
            values[finite]
            - minimum
        ) / scalar_range

    return (
        normalized,
        minimum,
        maximum
    )


# ============================================================
# BUILD U0 AND DIFFUSE IT
# ============================================================

def compute_weighted_heat_field(
    vertices,
    faces,
    explicit_indices,
    explicit_values,
    time_coefficient
):

    vertex_count = (
        vertices.shape[0]
    )

    if time_coefficient is None:

        time_coefficient = 1.0

    time_coefficient = float(
        time_coefficient
    )

    if time_coefficient < 0.0:

        raise ValueError(
            "t_coef cannot be negative."
        )

    # --------------------------------------------------------
    # Initial scalar field
    # --------------------------------------------------------

    # Every unspecified vertex begins at zero.
    initial_field = np.zeros(
        vertex_count,
        dtype=np.float64
    )

    # Overwrite only explicitly supplied vertices.
    for vertex_index, scalar_value in zip(
        explicit_indices,
        explicit_values
    ):

        initial_field[
            vertex_index
        ] = scalar_value

    # t_coef = 0 means no diffusion before the output
    # polarity conversion.
    if time_coefficient == 0.0:

        return (
            initial_field.copy(),
            initial_field,
            compute_mean_edge_length(
                vertices,
                faces
            ),
            0.0
        )

    # --------------------------------------------------------
    # Geometric operators from potpourri3d
    # --------------------------------------------------------

    vertex_areas = np.asarray(
        pp3d.vertex_areas(
            vertices,
            faces
        ),
        dtype=np.float64
    )

    laplacian = pp3d.cotan_laplacian(
        vertices,
        faces,
        denom_eps=1e-8
    ).tocsr()

    mass_matrix = diags(
        vertex_areas,
        offsets=0,
        shape=(
            vertex_count,
            vertex_count
        ),
        format="csr"
    )

    # --------------------------------------------------------
    # Heat time
    # --------------------------------------------------------

    average_edge_length = (
        compute_mean_edge_length(
            vertices,
            faces
        )
    )

    time_value = (
        average_edge_length ** 2
    ) * time_coefficient

    # --------------------------------------------------------
    # Backward-Euler heat diffusion
    #
    #     (M + tL) u = M u0
    # --------------------------------------------------------

    system_matrix = (
        mass_matrix
        + time_value * laplacian
    ).tolil()

    right_hand_side = (
        mass_matrix.dot(
            initial_field
        )
    )

    # Vertices not referenced by any nondegenerate face have
    # zero area and would create empty matrix rows.
    #
    # Preserve their initial value instead of making the
    # entire solve singular.
    inactive_vertices = np.where(
        vertex_areas <= 1e-14
    )[0]

    for vertex_index in inactive_vertices:

        system_matrix.rows[
            vertex_index
        ] = [
            int(vertex_index)
        ]

        system_matrix.data[
            vertex_index
        ] = [
            1.0
        ]

        right_hand_side[
            vertex_index
        ] = initial_field[
            vertex_index
        ]

    system_matrix = (
        system_matrix.tocsr()
    )

    diffused_field = spsolve(
        system_matrix,
        right_hand_side
    )

    diffused_field = np.asarray(
        diffused_field,
        dtype=np.float64
    )

    if (
        diffused_field.shape[0]
        != vertex_count
    ):

        raise RuntimeError(
            "The heat solve returned {} values for "
            "{} mesh vertices.".format(
                diffused_field.shape[0],
                vertex_count
            )
        )

    if not np.all(
        np.isfinite(
            diffused_field
        )
    ):

        invalid_count = int(
            np.count_nonzero(
                ~np.isfinite(
                    diffused_field
                )
            )
        )

        raise RuntimeError(
            "The heat solve produced {} non-finite "
            "values.".format(
                invalid_count
            )
        )

    return (
        diffused_field,
        initial_field,
        average_edge_length,
        time_value
    )


# ============================================================
# GRASSHOPPER EXECUTION
# ============================================================

vertices, faces = (
    rhino_mesh_to_arrays(
        mesh
    )
)


(
    parsed_seed_indices,
    parsed_seed_values
) = parse_seed_data(
    seed_data,
    vertices.shape[0]
)


(
    field_array,
    u0_array,
    computed_mean_edge_length,
    computed_diffusion_time
) = compute_weighted_heat_field(
    vertices=vertices,
    faces=faces,
    explicit_indices=parsed_seed_indices,
    explicit_values=parsed_seed_values,
    time_coefficient=t_coef
)


# ============================================================
# CONVERT DIFFUSION INTENSITY INTO A DISTANCE-LIKE FIELD
#
# Raw weighted diffusion:
#
#     high values near seeds
#     low values away from seeds
#
# Required scalar convention:
#
#     low values near seeds
#     high values away from seeds
#
# Preserve the original numeric range:
#
#     inverted = raw_min + raw_max - raw
#
# Both field and normalized_field use the same polarity.
# ============================================================

raw_field_min = float(
    np.min(
        field_array
    )
)

raw_field_max = float(
    np.max(
        field_array
    )
)

raw_field_range = (
    raw_field_max
    - raw_field_min
)


if raw_field_range > 1e-12:

    field_array = (
        raw_field_min
        + raw_field_max
        - field_array
    )

else:

    # A constant field has no directional gradient.
    field_array = (
        field_array.copy()
    )


# Normalize the already-inverted distance-like field.
(
    normalized_array,
    computed_min,
    computed_max
) = normalize_scalar_field(
    field_array
)


# ============================================================
# GRASSHOPPER OUTPUTS
# ============================================================

# Original mesh vertex order:
#
# points[i]
# field[i]
# normalized_field[i]
# u0[i]

points = [
    rg.Point3d(
        float(vertex[0]),
        float(vertex[1]),
        float(vertex[2])
    )
    for vertex in vertices
]


# Distance-like diffused field in the original numeric range.
#
# Low values are near the weighted seeds.
# High values are away from the weighted seeds.
field = [
    float(value)
    for value in field_array
]


# Normalized version of the distance-like field.
#
# Low values are near the weighted seeds.
# High values are away from the weighted seeds.
normalized_field = [
    float(value)
    for value in normalized_array
]


# Original diffusion excitation before solving and before
# polarity inversion.
u0 = [
    float(value)
    for value in u0_array
]


seed_indices = [
    int(index)
    for index in parsed_seed_indices
]


seed_values = [
    float(value)
    for value in parsed_seed_values
]


seed_points = [
    rg.Point3d(
        float(vertices[index, 0]),
        float(vertices[index, 1]),
        float(vertices[index, 2])
    )
    for index in parsed_seed_indices
]


mean_edge_length = (
    computed_mean_edge_length
)


diffusion_time = (
    computed_diffusion_time
)


field_min = (
    computed_min
)


field_max = (
    computed_max
)


info = (
    "Vertices: {}\n"
    "Triangles: {}\n"
    "Explicit seeds: {}\n"
    "Implicit zero vertices: {}\n"
    "u0 nonzero values: {}\n"
    "Output polarity: low near seeds, high away\n"
    "Field min: {:.9f}\n"
    "Field max: {:.9f}\n"
    "Mean edge length: {:.9f}\n"
    "t_coef: {:.9f}\n"
    "Diffusion time: {:.9f}"
).format(
    vertices.shape[0],
    faces.shape[0],
    len(seed_indices),
    vertices.shape[0] - len(seed_indices),
    int(
        np.count_nonzero(
            u0_array
        )
    ),
    field_min,
    field_max,
    mean_edge_length,
    float(t_coef),
    diffusion_time
)
# ---------- end vectorheatmethod ----------
pt = Point(vectorheatmethod.seed_points)
panel = Panel(vectorheatmethod.info)

# ---- group: Export field to run in ROS
panel_2 = Panel("C:\Users\m_psch\Downloads\RobArch Aarhus Workshop\3DP-DDS-main\m_psch_output")
exportfield = Python3Script(
    mesh=goal_mesh,
    field=vectorheatmethod.field,
    normalized_field=vectorheatmethod.normalized_field,
    folder=panel_2,
    write=Button())  # -> out, info; inputs mesh: Mesh, field: list of Double, normalized_field: list, folder: String, write: Boolean
# ---------- exportfield: Python ----------
# venv: heatmethod
"""
Grasshopper scalar-field exporter compatible with the ROS
field-state files.

Creates:
    field_state_init.npz
    field_masked_init.ply

Inputs
------
mesh
    Rhino Mesh already positioned in Grasshopper world
    coordinates.

    Grasshopper geometry is assumed to use millimetres.

field
    Distance-like diffused scalar field, one value per native
    mesh vertex.

    Low values are near the weighted seeds.
    High values are away from the weighted seeds.

normalized_field
    Normalized version of field, one value per native mesh
    vertex.

    Expected range: [0, 1].

    Low values are near the weighted seeds.
    High values are away from the weighted seeds.

folder
    Destination folder.

write
    Boolean trigger. Preferably connect a Grasshopper Button.

Output
------
info
    Export status.
"""

import os
import numpy as np


# ============================================================
# MESH CONVERSION
# ============================================================

def mesh_to_arrays(rhino_mesh):

    if rhino_mesh is None:
        raise ValueError(
            "No mesh was provided."
        )

    if rhino_mesh.Vertices.Count == 0:
        raise ValueError(
            "The mesh has no vertices."
        )

    if rhino_mesh.Faces.Count == 0:
        raise ValueError(
            "The mesh has no faces."
        )

    vertices = np.array(
        [
            [
                float(vertex.X),
                float(vertex.Y),
                float(vertex.Z)
            ]
            for vertex in rhino_mesh.Vertices
        ],
        dtype=np.float64
    )

    triangle_faces = []

    for face_item in rhino_mesh.Faces:

        if face_item.IsTriangle:

            triangle_faces.append(
                [
                    int(face_item.A),
                    int(face_item.B),
                    int(face_item.C)
                ]
            )

        else:

            # Split quad A-B-C-D into:
            #
            # A-B-C
            # A-C-D

            triangle_faces.append(
                [
                    int(face_item.A),
                    int(face_item.B),
                    int(face_item.C)
                ]
            )

            triangle_faces.append(
                [
                    int(face_item.A),
                    int(face_item.C),
                    int(face_item.D)
                ]
            )

    faces = np.asarray(
        triangle_faces,
        dtype=np.int32
    )

    return vertices, faces


# ============================================================
# SCALAR VALIDATION
# ============================================================

def read_scalar_list(
    values,
    vertex_count,
    input_name
):

    if values is None:

        raise ValueError(
            "{} was not provided.".format(
                input_name
            )
        )

    scalar_array = np.asarray(
        list(values),
        dtype=np.float64
    ).reshape(-1)

    if scalar_array.shape[0] != vertex_count:

        raise ValueError(
            "{} contains {} values, but the mesh has "
            "{} vertices.".format(
                input_name,
                scalar_array.shape[0],
                vertex_count
            )
        )

    if not np.all(
        np.isfinite(
            scalar_array
        )
    ):

        raise ValueError(
            "{} contains NaN or infinite values.".format(
                input_name
            )
        )

    return scalar_array


# ============================================================
# PLY COLORS
# ============================================================

def make_yellow_to_red_colors(
    normalized_scalar
):

    """
    normalized_field = 0 -> yellow
    normalized_field = 1 -> red
    """

    clipped = np.clip(
        normalized_scalar,
        0.0,
        1.0
    )

    colors = np.zeros(
        (
            clipped.shape[0],
            3
        ),
        dtype=np.uint8
    )

    colors[:, 0] = 255

    colors[:, 1] = np.rint(
        255.0
        * (
            1.0
            - clipped
        )
    ).astype(
        np.uint8
    )

    colors[:, 2] = 0

    return colors


# ============================================================
# BINARY PLY WRITER
# ============================================================

def write_binary_ply(
    path,
    points,
    colors
):

    if points.shape[0] != colors.shape[0]:

        raise ValueError(
            "Point count and color count do not match."
        )

    vertex_count = (
        points.shape[0]
    )

    header = (
        "ply\n"
        "format binary_little_endian 1.0\n"
        "comment Created by Grasshopper scalar field exporter\n"
        "element vertex {}\n"
        "property double x\n"
        "property double y\n"
        "property double z\n"
        "property uchar red\n"
        "property uchar green\n"
        "property uchar blue\n"
        "end_header\n"
    ).format(
        vertex_count
    )

    record_dtype = np.dtype(
        [
            ("x", "<f8"),
            ("y", "<f8"),
            ("z", "<f8"),
            ("red", "u1"),
            ("green", "u1"),
            ("blue", "u1")
        ]
    )

    records = np.empty(
        vertex_count,
        dtype=record_dtype
    )

    records["x"] = points[:, 0]
    records["y"] = points[:, 1]
    records["z"] = points[:, 2]

    records["red"] = colors[:, 0]
    records["green"] = colors[:, 1]
    records["blue"] = colors[:, 2]

    with open(
        path,
        "wb"
    ) as output_file:

        output_file.write(
            header.encode(
                "ascii"
            )
        )

        records.tofile(
            output_file
        )


# ============================================================
# READ GRASSHOPPER INPUTS
# ============================================================

vertices_mm, faces = mesh_to_arrays(
    mesh
)

vertex_count = (
    vertices_mm.shape[0]
)


input_field = read_scalar_list(
    field,
    vertex_count,
    "field"
)


input_normalized_field = read_scalar_list(
    normalized_field,
    vertex_count,
    "normalized_field"
)


# normalized_field should already use the [0,1] range.
normalized_min = float(
    np.min(
        input_normalized_field
    )
)

normalized_max = float(
    np.max(
        input_normalized_field
    )
)

range_tolerance = 1e-9

if (
    normalized_min < -range_tolerance
    or normalized_max > 1.0 + range_tolerance
):

    raise ValueError(
        "normalized_field must use the range [0, 1]. "
        "Received range: {:.9f} to {:.9f}.".format(
            normalized_min,
            normalized_max
        )
    )


# ============================================================
# PRESERVE THE SCALAR CONVENTION
#
# The heat component already supplies:
#
#     low values near seeds
#     high values away from seeds
#
# Do not invert either scalar again.
# ============================================================

heat_dist = (
    input_field.copy()
)

heat_norm = np.clip(
    input_normalized_field,
    0.0,
    1.0
)


# ============================================================
# GEOMETRY, ROBOT-FRAME ROTATION AND UNITS
# ============================================================

# Rotation of 180 degrees around world Z, centered at:
#
#     X = 0
#     Y = 0
#     Z = 0
#
# Transformation:
#
#     x_robot = -x_gh
#     y_robot = -y_gh
#     z_robot =  z_gh

rotation_z_180 = np.array(
    [
        [-1.0,  0.0, 0.0],
        [ 0.0, -1.0, 0.0],
        [ 0.0,  0.0, 1.0]
    ],
    dtype=np.float64
)


# Each vertex is a row vector, hence rotation.T.
vertices_robot_mm = vertices_mm.dot(
    rotation_z_180.T
)


# Rotated geometry in millimetres.
field_vertices = (
    vertices_robot_mm.copy()
)


# Convert robot-frame geometry from millimetres to metres.
scale_value = 0.001

field_vertices_scaled = (
    vertices_robot_mm
    * scale_value
)

field_vertices_world = (
    vertices_robot_mm
    * scale_value
)


# ============================================================
# PLACEHOLDER PIPELINE VALUES
# ============================================================

phi = np.zeros(
    vertex_count,
    dtype=np.float64
)


viable = np.ones(
    vertex_count,
    dtype=np.uint8
)


# ============================================================
# COMPATIBILITY METADATA
# ============================================================

offset_xyz = np.zeros(
    3,
    dtype=np.float64
)


field_scale = np.array(
    [scale_value],
    dtype=np.float64
)


seed_level = np.array(
    [np.nan],
    dtype=np.float64
)


t_coef_metadata = np.array(
    [np.nan],
    dtype=np.float64
)


clearance = np.array(
    [0.0],
    dtype=np.float64
)


position_target_enabled = np.array(
    [0],
    dtype=np.uint8
)


position_target_xy = np.array(
    [
        np.nan,
        np.nan
    ],
    dtype=np.float64
)


position_target_world_xy = np.array(
    [
        np.nan,
        np.nan
    ],
    dtype=np.float64
)


positioned_centroid_xy = np.mean(
    field_vertices_world[:, :2],
    axis=0
).astype(
    np.float64
)


# ============================================================
# VISUALIZATION COLORS
# ============================================================

colors = make_yellow_to_red_colors(
    heat_norm
)


# ============================================================
# OUTPUT PATHS
# ============================================================

if (
    folder is None
    or str(folder).strip() == ""
):

    raise ValueError(
        "Provide an output folder."
    )


output_folder = os.path.abspath(
    os.path.expanduser(
        str(folder)
    )
)


npz_path = os.path.join(
    output_folder,
    "field_state_init.npz"
)


ply_path = os.path.join(
    output_folder,
    "field_masked_init.ply"
)


# ============================================================
# EXPORT
# ============================================================

if bool(write):

    os.makedirs(
        output_folder,
        exist_ok=True
    )

    np.savez_compressed(
        npz_path,

        field_vertices=np.asarray(
            field_vertices,
            dtype=np.float64
        ),

        field_faces=np.asarray(
            faces,
            dtype=np.int32
        ),

        field_vertices_scaled=np.asarray(
            field_vertices_scaled,
            dtype=np.float64
        ),

        field_vertices_world=np.asarray(
            field_vertices_world,
            dtype=np.float64
        ),

        heat_dist=np.asarray(
            heat_dist,
            dtype=np.float64
        ),

        heat_norm=np.asarray(
            heat_norm,
            dtype=np.float64
        ),

        phi=np.asarray(
            phi,
            dtype=np.float64
        ),

        viable=np.asarray(
            viable,
            dtype=np.uint8
        ),

        offset_xyz=np.asarray(
            offset_xyz,
            dtype=np.float64
        ),

        field_scale=np.asarray(
            field_scale,
            dtype=np.float64
        ),

        seed_level=np.asarray(
            seed_level,
            dtype=np.float64
        ),

        t_coef=np.asarray(
            t_coef_metadata,
            dtype=np.float64
        ),

        clearance=np.asarray(
            clearance,
            dtype=np.float64
        ),

        position_target_enabled=np.asarray(
            position_target_enabled,
            dtype=np.uint8
        ),

        position_target_xy=np.asarray(
            position_target_xy,
            dtype=np.float64
        ),

        position_target_world_xy=np.asarray(
            position_target_world_xy,
            dtype=np.float64
        ),

        positioned_centroid_xy=np.asarray(
            positioned_centroid_xy,
            dtype=np.float64
        )
    )

    write_binary_ply(
        ply_path,
        field_vertices_world,
        colors
    )

    info = (
        "Files saved successfully.\n"
        "Vertices: {}\n"
        "Triangles: {}\n"
        "Scalar polarity preserved: low near seeds, high away\n"
        "Field range: {:.9f} to {:.9f}\n"
        "Normalized field range: {:.9f} to {:.9f}\n"
        "World scale: {} metres per GH unit\n"
        "NPZ: {}\n"
        "PLY: {}"
    ).format(
        vertex_count,
        faces.shape[0],
        float(
            np.min(
                heat_dist
            )
        ),
        float(
            np.max(
                heat_dist
            )
        ),
        float(
            np.min(
                heat_norm
            )
        ),
        float(
            np.max(
                heat_norm
            )
        ),
        scale_value,
        npz_path,
        ply_path
    )

else:

    info = (
        "Ready to export.\n"
        "Set write to True.\n"
        "Vertices: {}\n"
        "Triangles: {}\n"
        "Scalar polarity will be preserved.\n"
        "World coordinates will be converted from mm to m.\n"
        "NPZ: {}\n"
        "PLY: {}"
    ).format(
        vertex_count,
        faces.shape[0],
        npz_path,
        ply_path
    )
# ---------- end exportfield ----------
panel_3 = Panel(exportfield.info)

# ---- group: Color diagram of the Field Values
bnd = Bounds(Numbers=vectorheatmethod.field)
dedomain = DeconstructDomain(Domain=bnd)  # -> Start, End
gradient = Gradient(
    LowerLimit=dedomain.Start,
    UpperLimit=dedomain.End,
    Parameter=vectorheatmethod.field,
    stops=[0: RGB(255, 234, 0), 0.498: RGB(255, 128, 0), 1: RGB(255, 0, 0)])
mcol = MeshColours(Mesh=goal_mesh, Colours=gradient)

# ---- group: DDS Representation / DDS Domain
bbox = BoundingBox(Content=goal_mesh, Plane=PlaneXY(0, 0, 0), UnionBox=True)  # -> Box, Box_2
offset = Slider(20, range=0..100)
box_corners = BoxCorners(Box=bbox.Box)  # -> CornerA, CornerB, CornerC, CornerD, CornerE, CornerF, CornerG, CornerH
pt_2 = Point(box_corners.CornerA)
pt_3 = Point(box_corners.CornerG)
vec_2 = VectorXYZ(XComponent=offset, YComponent=offset, ZComponent=offset)  # -> Vector, Length
move_2 = Move(Geometry=pt_2, Motion=expr("x*-1", vec_2.Vector))  # -> Geometry, Transform
move_3 = Move(Geometry=pt_3, Motion=vec_2.Vector)  # -> Geometry, Transform
box = Box2Pt(PointA=move_2.Geometry, PointB=move_3.Geometry, Plane=PlaneXY(0, 0, 0))

# ----
panel_4 = Panel("C:\Users\m_psch\Downloads\RobArch Aarhus Workshop\3DP-DDS-main\src")
dds_setup = Python3Script(run=Button(), package_path=panel_4)  # -> out, DDSPath; inputs run: Boolean, package_path: String
# ---------- dds_setup: Python ----------
# venv: dds
# DDS Setup
# Inputs: package_path, run
# Outputs: DDSPath
# r: numpy==2.0.2, scipy==1.13.1, scikit-image==0.24.0
#
# - package_path points at the repository `src` folder, not the repository root.
# - Use a Button for run. The path is stored in scriptcontext.sticky so it
#   remains available after the button releases.
# - This only points Rhino Python at DDS source code. It does not install
#   runtime dependencies such as numpy, scipy, or scikit-image.
# - DDSPath should resolve to `.../3DP-DDS/src/dds/__init__.py`; any other path
#   means Rhino is importing a different DDS copy.

import sys
import scriptcontext as sc

KEY = "dds.gh_helpers.source_path"

if run and package_path:
    sc.sticky[KEY] = package_path

DDS_SRC = sc.sticky.get(KEY, package_path)

if DDS_SRC and DDS_SRC not in sys.path:
    sys.path.insert(0, DDS_SRC)

OK = False
DDSPath = None

if DDS_SRC:
    try:
        import dds
        import dds.gh_helpers

        DDSPath = dds.__file__
        if bool(DDSPath and DDSPath.startswith(DDS_SRC)):
            print("DDS loaded from:", DDSPath)
        else:
            print("DDS imported from unexpected path:", DDSPath)
    except Exception as exc:
        DDSPath = None
        print("DDS setup failed:", repr(exc))
else:
    print("Press run with package_path set to the DDS src folder.")
# ---------- end dds_setup ----------

# ---- group: DDS Representation
box_2 = Box(box)
dds_domain = Python3Script(Box=box_2, voxel_size=Slider(2.5, range=0.1..3))  # -> out, Domain; inputs Box: Box
# ---------- dds_domain: Python ----------
# venv: dds
# DDS Domain Box
# Inputs: Box, voxel_size
# Outputs: Domain
#
# - Box is a Rhino box or any object with a bounding box.
# - DDS domains are axis-aligned dense voxel grids; rotated Rhino boxes are
#   converted through their world-axis bounding box.
# - voxel_size is in the active Rhino model units. The GH helper records this
#   as millimeters internally, but it does not convert units.
# - Bounds are expanded upward to whole voxels, so Domain.max_corner may be
#   slightly larger than the input box.
# - Runtime cost scales with grid_shape[0] * grid_shape[1] * grid_shape[2].

from dds.gh_helpers.components import make_domain_from_box

Domain = None
PreviewBox = None

try:
    Domain, PreviewBox = make_domain_from_box(Box, voxel_size)
    print("Domain:", Domain.grid_shape, "voxels")
except Exception as exc:
    print("Domain creation failed:", repr(exc))
# ---------- end dds_domain ----------

# ---- group: Simulate Loop
preview_cycles = Slider(43, range=0..100)
run_loop = BooleanToggle(False)
reset_loop = Button()
number_slider_7 = Slider(55, range=0..100)
panel_5 = Panel("dds_loop_01")

# ---- group: Export width field to run in ROS
panel_6 = Panel("C:\Users\m_psch\Downloads\RobArch Aarhus Workshop\3DP-DDS-main\m_psch_output")

# ---- group: Variable width candidate generation
subtraction = Subtraction(A="1", B=vectorheatmethod.normalized_field)
abs = Absolute(Value=subtraction)

# ---- group: Export width field to run in ROS (continued)
exportwidthfield = Python3Script(mesh=goal_mesh, width_field=abs, folder=panel_6, write=Button())  # -> out, info; inputs mesh: Mesh, width_field: list, folder: String, write: Boolean
# ---------- exportwidthfield: Python ----------
# venv: heatmethod
"""
Grasshopper normalized width-field exporter for ROS/lib_scalar.

Creates
-------
width_field.npz
    Contains a single float64 array named ``width_norm``.

Grasshopper inputs
------------------
mesh
    Rhino Mesh whose native vertex ordering matches the field mesh used by
    ROS. The mesh is used only to validate the number of width values; its
    geometry is not exported.

width_field
    Normalized width field, one value per native mesh vertex.

    Required range: [0, 1].

    The candidate-generation component later maps these values to the width
    domain:

        0 -> minimum width
        1 -> maximum width

folder
    Destination folder.

write
    Boolean trigger. Preferably connect a Grasshopper Button.

Grasshopper output
------------------
info
    Export status and diagnostics.

Notes
-----
This exporter intentionally has no unnormalized field, mesh geometry, heat,
phi, viability, PLY, unit conversion, or field-state metadata. It writes only
the normalized width map required by
``lib_scalar.load_normalized_width_map``.
"""

import os

import numpy as np


WIDTH_MAP_KEY = "width_norm"
OUTPUT_FILENAME = "width_field.npz"
RANGE_TOLERANCE = 1e-6


# ============================================================
# VALIDATE MESH AND WIDTH FIELD
# ============================================================

if mesh is None:
    raise ValueError("No mesh was provided.")

vertex_count = int(mesh.Vertices.Count)

if vertex_count == 0:
    raise ValueError("The mesh has no vertices.")

if width_field is None:
    raise ValueError("width_field was not provided.")


width_norm = np.asarray(
    list(width_field),
    dtype=np.float64
).reshape(-1)


if width_norm.shape[0] != vertex_count:
    raise ValueError(
        "width_field contains {} values, but the mesh has {} vertices.".format(
            width_norm.shape[0],
            vertex_count
        )
    )

if not np.all(np.isfinite(width_norm)):
    raise ValueError("width_field contains NaN or infinite values.")


observed_min = float(np.min(width_norm))
observed_max = float(np.max(width_norm))

if (
    observed_min < -RANGE_TOLERANCE
    or observed_max > 1.0 + RANGE_TOLERANCE
):
    raise ValueError(
        "width_field must be normalized to [0, 1]. "
        "Observed range: {:.9f} to {:.9f}.".format(
            observed_min,
            observed_max
        )
    )


# Match the ROS loader: tolerate tiny numerical excursions, then clamp.
width_norm = np.clip(width_norm, 0.0, 1.0)


# ============================================================
# OUTPUT PATH
# ============================================================

if folder is None or str(folder).strip() == "":
    raise ValueError("Provide an output folder.")


output_folder = os.path.abspath(
    os.path.expanduser(str(folder))
)

npz_path = os.path.join(
    output_folder,
    OUTPUT_FILENAME
)


# ============================================================
# EXPORT
# ============================================================

if bool(write):
    os.makedirs(output_folder, exist_ok=True)

    np.savez_compressed(
        npz_path,
        width_norm=np.asarray(width_norm, dtype=np.float64)
    )

    # Read the file back immediately to verify its public contract.
    with np.load(npz_path, allow_pickle=False) as payload:
        if WIDTH_MAP_KEY not in payload:
            raise RuntimeError(
                "Export verification failed: '{}' is missing.".format(
                    WIDTH_MAP_KEY
                )
            )

        verified = np.asarray(
            payload[WIDTH_MAP_KEY],
            dtype=np.float64
        ).reshape(-1)

    if verified.shape[0] != vertex_count:
        raise RuntimeError(
            "Export verification failed: saved {} values, expected {}.".format(
                verified.shape[0],
                vertex_count
            )
        )

    info = (
        "Width field saved successfully.\n"
        "Vertices / values: {}\n"
        "NPZ key: {}\n"
        "Normalized range: {:.9f} to {:.9f}\n"
        "File: {}"
    ).format(
        vertex_count,
        WIDTH_MAP_KEY,
        float(np.min(verified)),
        float(np.max(verified)),
        npz_path
    )

else:
    info = (
        "Ready to export width field.\n"
        "Set write to True.\n"
        "Vertices / values: {}\n"
        "NPZ key: {}\n"
        "Normalized range: {:.9f} to {:.9f}\n"
        "File: {}"
    ).format(
        vertex_count,
        WIDTH_MAP_KEY,
        float(np.min(width_norm)),
        float(np.max(width_norm)),
        npz_path
    )
# ---------- end exportwidthfield ----------
panel_7 = Panel(exportwidthfield.info)

# ---- group: DDS Representation
panel_8 = Panel("2")

addition_2 = Addition(A=number_slider_4, B=panel_8)

# ---- group: Simulate Loop
state_reader = Python3Script(initial_scan=scan_mesh, reset=reset_loop, loop_id=panel_5)  # -> out, scan_mesh, bead_meshes, iteration, running, target_history, info; inputs initial_scan: Mesh, reset: Boolean, loop_id: String
# ---------- state_reader: Python ----------
# venv: heatmethod
"""
Persistent scan, bead and target-history reader.

Inputs:
    initial_scan
        Original scan mesh. It remains unchanged during the loop.

    reset
        Boolean button. Restores the original scan and clears all history.

    loop_id
        Text identifier shared with the Mesh State Writer.

Outputs:
    scan_mesh
        Original scan mesh.

    bead_meshes
        Accumulated bead meshes.

    current_mesh
        Combined scan and bead geometry.

    target_history
        DataTree of target planes.
        Each branch contains the targets generated during one iteration.

    iteration
        Number of completed iterations.

    running
        True while the loop is active.

    info
        Compact current-state information.
"""

import System
import Rhino.Geometry as rg
import Grasshopper
import scriptcontext as sc

from Grasshopper.Kernel.Data import GH_Path


STATE_VERSION = 3
EPSILON = 1.0e-12


def duplicate_mesh(mesh):
    """Duplicate a Rhino mesh to avoid sharing mutable references."""
    if mesh is None:
        return None

    return mesh.DuplicateMesh()


def get_state_key(identifier):
    """Build the shared sticky key."""
    text = str(identifier).strip() if identifier is not None else ""

    if not text:
        text = "default_dds_loop"

    return "BEHAV3D_SCAN_BEADS_PLANES_V3::" + text


def create_state(scan):
    """Create a clean persistent loop state."""
    return {
        "version": STATE_VERSION,
        "scan_mesh": duplicate_mesh(scan),
        "bead_meshes": [],
        "plane_history": [],
        "total_beads": 0,
        "iteration": 0,
        "running": False,
        "scheduled": False,
        "reader_guid": str(ghenv.Component.InstanceGuid)
    }


def combine_meshes(scan, beads):
    """Append scan and bead meshes without performing a Boolean union."""
    combined = rg.Mesh()
    geometry_added = False

    if scan is not None:
        combined.Append(scan)
        geometry_added = True

    for bead in beads:
        if bead is not None:
            combined.Append(bead)
            geometry_added = True

    if not geometry_added:
        return None

    combined.Normals.ComputeNormals()
    combined.Compact()

    return combined


def record_to_plane(record):
    """Reconstruct a Rhino Plane from its stored Origin and Z axis."""
    origin_values = record.get("origin", (0.0, 0.0, 0.0))
    z_values = record.get("z", (0.0, 0.0, 1.0))

    origin = rg.Point3d(
        float(origin_values[0]),
        float(origin_values[1]),
        float(origin_values[2])
    )

    z_axis = rg.Vector3d(
        float(z_values[0]),
        float(z_values[1]),
        float(z_values[2])
    )

    if z_axis.Length <= EPSILON:
        z_axis = rg.Vector3d.ZAxis
    else:
        z_axis.Unitize()

    # Construct a plane whose normal is the stored target Z direction.
    return rg.Plane(origin, z_axis)


def build_target_tree(state):
    """
    Build one Grasshopper branch per completed iteration.

    Branch {0} corresponds to iteration 1.
    Branch {1} corresponds to iteration 2, and so forth.
    """
    tree = Grasshopper.DataTree[System.Object]()
    history = state.get("plane_history", [])

    for branch_index, iteration_record in enumerate(history):
        path = GH_Path(branch_index)
        plane_records = iteration_record.get("planes", [])

        # Ensure an empty iteration still has a branch.
        tree.EnsurePath(path)

        for plane_record in plane_records:
            plane = record_to_plane(plane_record)
            tree.Add(plane, path)

    return tree


STATE_KEY = get_state_key(loop_id)
state = sc.sticky.get(STATE_KEY)

requires_initialization = (
    state is None or
    state.get("version") != STATE_VERSION or
    bool(reset)
)

if requires_initialization:
    state = create_state(initial_scan)
    sc.sticky[STATE_KEY] = state


state["reader_guid"] = str(ghenv.Component.InstanceGuid)
state.setdefault("plane_history", [])
state.setdefault("total_beads", 0)


scan_mesh = duplicate_mesh(state.get("scan_mesh"))

bead_meshes = [
    duplicate_mesh(mesh)
    for mesh in state.get("bead_meshes", [])
    if mesh is not None
]

current_mesh = combine_meshes(
    scan_mesh,
    bead_meshes
)

target_history = build_target_tree(state)

iteration = int(state.get("iteration", 0))
running = bool(state.get("running", False))
total_bead_count = int(state.get("total_beads", 0))

info = (
    "Loop ID: {}\n"
    "Iteration: {}\n"
    "Running: {}\n"
    "Scan stored: {}\n"
    "Stored bead meshes: {}\n"
    "Target-history branches: {}\n"
    "Total beads: {}"
).format(
    loop_id,
    iteration,
    running,
    scan_mesh is not None,
    len(bead_meshes),
    target_history.BranchCount,
    total_bead_count
)
# ---------- end state_reader ----------
mjoin_2 = MeshJoin(Meshes=flatten([state_reader.scan_mesh, state_reader.bead_meshes]))

outputplanes = Plane(state_reader.target_history)

# ---- group: Variable width candidate generation (continued)
intersect = Python3Script(FieldMesh=goal_mesh, Heat=vectorheatmethod.field, ScanMesh=mjoin_2)  # -> out, Contours, ContourHeat, ContourPoints, Phi, Viable, Info; inputs FieldMesh: Mesh, Heat: list of Double, ScanMesh: Mesh
# ---------- intersect: Python ----------
# venv: heatmethod

import math

import Rhino
import Rhino.Geometry as rg
from Rhino.Geometry.Intersect import Intersection


# ============================================================
# CONFIGURATION
# ============================================================

TOLERANCE = 1e-6

if Rhino.RhinoDoc.ActiveDoc is not None:
    TOLERANCE = float(
        Rhino.RhinoDoc.ActiveDoc.ModelAbsoluteTolerance
    )

EPSILON = max(1e-12, TOLERANCE * 1e-6)


# ============================================================
# VALIDATE INPUTS
# ============================================================

if FieldMesh is None:
    raise ValueError("FieldMesh is missing.")

if ScanMesh is None:
    raise ValueError("ScanMesh is missing.")

if FieldMesh.Vertices.Count == 0:
    raise ValueError("FieldMesh has no vertices.")

if FieldMesh.Faces.Count == 0:
    raise ValueError("FieldMesh has no faces.")

if ScanMesh.Vertices.Count == 0:
    raise ValueError("ScanMesh has no vertices.")

if ScanMesh.Faces.Count == 0:
    raise ValueError("ScanMesh has no faces.")


heat = [float(value) for value in Heat]

if len(heat) != FieldMesh.Vertices.Count:
    raise ValueError(
        "Heat must contain one value for every native "
        "FieldMesh vertex. Received {}, expected {}.".format(
            len(heat),
            FieldMesh.Vertices.Count
        )
    )

if not all(math.isfinite(value) for value in heat):
    raise ValueError(
        "Heat contains NaN or infinite values."
    )


# ============================================================
# HELPERS
# ============================================================

def mesh_point(mesh, index):
    vertex = mesh.Vertices[index]

    return rg.Point3d(
        float(vertex.X),
        float(vertex.Y),
        float(vertex.Z)
    )


def mesh_triangles(mesh):
    """
    Return triangle vertex indices without modifying the
    original mesh vertex order.

    Quad faces are locally divided as:
        A-B-C
        A-C-D
    """

    for face in mesh.Faces:
        a = int(face.A)
        b = int(face.B)
        c = int(face.C)

        yield a, b, c

        if face.IsQuad:
            d = int(face.D)
            yield a, c, d


def interpolate_point(point_a, point_b, parameter):
    return rg.Point3d(
        point_a.X
        + parameter * (point_b.X - point_a.X),

        point_a.Y
        + parameter * (point_b.Y - point_a.Y),

        point_a.Z
        + parameter * (point_b.Z - point_a.Z)
    )


def spatial_cell(point):
    """
    Return a spatial hash key used to merge coincident
    contour points.
    """

    return (
        int(math.floor(point.X / TOLERANCE)),
        int(math.floor(point.Y / TOLERANCE)),
        int(math.floor(point.Z / TOLERANCE))
    )


# ============================================================
# CALCULATE PHI FOR EVERY FIELD VERTEX
#
# phi = field_z - scan_z
# ============================================================

field_bbox = FieldMesh.GetBoundingBox(True)
scan_bbox = ScanMesh.GetBoundingBox(True)

scene_size = max(
    field_bbox.Diagonal.Length,
    scan_bbox.Diagonal.Length,
    1.0
)

z_top = (
    max(
        field_bbox.Max.Z,
        scan_bbox.Max.Z
    )
    + scene_size
)

down_direction = rg.Vector3d(
    0.0,
    0.0,
    -1.0
)


# OUTPUT: Signed vertical distance from every FieldMesh
# vertex to the ScanMesh.
Phi = []


# OUTPUT: ScanMesh Z coordinate found below every
# FieldMesh vertex. NaN means that no scan hit was found.
ScanZ = []


# OUTPUT: True when the vertical ray from a FieldMesh
# vertex intersects the ScanMesh.
HasHit = []


# OUTPUT: True when a scan hit exists and Phi is
# greater than zero.
Viable = []


for vertex in FieldMesh.Vertices:

    field_point = rg.Point3d(
        float(vertex.X),
        float(vertex.Y),
        float(vertex.Z)
    )

    ray_origin = rg.Point3d(
        field_point.X,
        field_point.Y,
        z_top
    )

    ray = rg.Ray3d(
        ray_origin,
        down_direction
    )

    ray_parameter = float(
        Intersection.MeshRay(
            ScanMesh,
            ray
        )
    )

    hit = (
        ray_parameter >= 0.0
        and math.isfinite(ray_parameter)
    )

    if hit:
        scan_z = z_top - ray_parameter

        phi_value = (
            field_point.Z
            - scan_z
        )

    else:
        scan_z = float("nan")
        phi_value = float("-inf")

    ScanZ.append(scan_z)
    Phi.append(phi_value)
    HasHit.append(hit)

    Viable.append(
        hit
        and phi_value > 0.0
    )


# ============================================================
# CONTOUR GRAPH STORAGE
# ============================================================


# OUTPUT: Unique points forming the Phi = 0 contour graph.
ContourPoints = []


heat_sums = []
heat_counts = []

spatial_buckets = {}
edge_set = set()


def add_contour_point(point, heat_value):
    """
    Add a point to the contour graph.

    If another point is already within TOLERANCE,
    reuse the existing point index.
    """

    cell = spatial_cell(point)

    for dx in (-1, 0, 1):
        for dy in (-1, 0, 1):
            for dz in (-1, 0, 1):

                neighbour_cell = (
                    cell[0] + dx,
                    cell[1] + dy,
                    cell[2] + dz
                )

                indices = spatial_buckets.get(
                    neighbour_cell,
                    []
                )

                for index in indices:

                    existing_point = ContourPoints[index]

                    if (
                        existing_point.DistanceTo(point)
                        <= TOLERANCE
                    ):
                        heat_sums[index] += float(
                            heat_value
                        )

                        heat_counts[index] += 1

                        return index

    new_index = len(ContourPoints)

    ContourPoints.append(point)

    heat_sums.append(
        float(heat_value)
    )

    heat_counts.append(1)

    spatial_buckets.setdefault(
        cell,
        []
    ).append(new_index)

    return new_index


def add_contour_edge(crossing_a, crossing_b):
    """
    Add one internal connection between two contour points.
    """

    point_a, heat_a = crossing_a
    point_b, heat_b = crossing_b

    index_a = add_contour_point(
        point_a,
        heat_a
    )

    index_b = add_contour_point(
        point_b,
        heat_b
    )

    if index_a == index_b:
        return

    if index_a < index_b:
        edge = index_a, index_b
    else:
        edge = index_b, index_a

    edge_set.add(edge)


# ============================================================
# EXTRACT PHI = 0 CROSSINGS FROM FIELD MESH TRIANGLES
# ============================================================

for triangle in mesh_triangles(FieldMesh):

    crossings = []

    triangle_edges = (
        (0, 1),
        (1, 2),
        (2, 0)
    )

    for local_a, local_b in triangle_edges:

        index_a = triangle[local_a]
        index_b = triangle[local_b]

        value_a = Phi[index_a]
        value_b = Phi[index_b]

        # Skip edges without valid scan information.
        if not (
            math.isfinite(value_a)
            and math.isfinite(value_b)
        ):
            continue

        # Both vertices lie exactly on Phi = 0.
        if (
            abs(value_a) <= EPSILON
            and abs(value_b) <= EPSILON
        ):
            continue

        # Both vertices are above the zero level.
        if (
            value_a > EPSILON
            and value_b > EPSILON
        ):
            continue

        # Both vertices are below the zero level.
        if (
            value_a < -EPSILON
            and value_b < -EPSILON
        ):
            continue

        denominator = (
            value_a
            - value_b
        )

        if abs(denominator) <= EPSILON:
            continue

        parameter = (
            value_a
            / denominator
        )

        parameter = max(
            0.0,
            min(1.0, parameter)
        )

        point_a = mesh_point(
            FieldMesh,
            index_a
        )

        point_b = mesh_point(
            FieldMesh,
            index_b
        )

        crossing_point = interpolate_point(
            point_a,
            point_b,
            parameter
        )

        crossing_heat = (
            heat[index_a]
            + parameter
            * (
                heat[index_b]
                - heat[index_a]
            )
        )

        duplicate = False

        for existing_point, existing_heat in crossings:

            if (
                existing_point.DistanceTo(
                    crossing_point
                )
                <= TOLERANCE
            ):
                duplicate = True
                break

        if not duplicate:
            crossings.append(
                (
                    crossing_point,
                    crossing_heat
                )
            )

    if len(crossings) == 2:

        add_contour_edge(
            crossings[0],
            crossings[1]
        )

    elif len(crossings) > 2:

        best_pair = None
        best_distance = -1.0

        for i in range(len(crossings)):

            for j in range(
                i + 1,
                len(crossings)
            ):

                distance = (
                    crossings[i][0].DistanceTo(
                        crossings[j][0]
                    )
                )

                if distance > best_distance:

                    best_distance = distance

                    best_pair = (
                        crossings[i],
                        crossings[j]
                    )

        if best_pair is not None:

            add_contour_edge(
                best_pair[0],
                best_pair[1]
            )


# ============================================================
# BUILD FINAL OUTPUTS
# ============================================================

sorted_edges = sorted(edge_set)


# OUTPUT: Heat value interpolated at every ContourPoint.
# ContourHeat[i] corresponds to ContourPoints[i].
ContourHeat = [
    total / float(count)
    for total, count in zip(
        heat_sums,
        heat_counts
    )
]


# Internal segments required only to join the final curves.
segments = [
    rg.LineCurve(
        ContourPoints[index_a],
        ContourPoints[index_b]
    )
    for index_a, index_b in sorted_edges
]


# OUTPUT: Joined curves representing the Phi = 0 contour.
if segments:

    Contours = list(
        rg.Curve.JoinCurves(
            segments,
            TOLERANCE
        )
    )

else:
    Contours = []


# OUTPUT: Diagnostic summary of the calculation.
Info = (
    "field_vertices={} | "
    "scan_hits={} | "
    "viable={} | "
    "contour_points={} | "
    "contour_connections={} | "
    "joined_curves={}"
).format(
    len(Phi),

    sum(
        1
        for value in HasHit
        if value
    ),

    sum(
        1
        for value in Viable
        if value
    ),

    len(ContourPoints),

    len(sorted_edges),

    len(Contours)
)
# ---------- end intersect ----------
crv = Curve(intersect.Contours)
variable_width_candidate_generation = Python3Script(
    mode=list,
    field_mesh=goal_mesh,
    contours=intersect.Contours,
    normalized_field=vectorheatmethod.normalized_field,
    normalized_width_field=abs,
    width_range=width_range,
    overlap=overlap,
    merge_tolerance=number_slider_3,
    max_count=number_slider_2,
    height=number_slider_4)  # -> out, source_points, candidate_points, lift_directions, candidate_widths, info; inputs mode: String, field_mesh: Mesh, contours: list of Curve, normalized_field: list of Double, normalized_width_field: list of Double, width_range: Interval, merge_tolerance: Double, max_count: Int32, height: Double
# ---------- variable_width_candidate_generation: Python ----------
# venv: heatmethod
"""
Variable-width candidate selection and lift generation.

Grasshopper inputs
------------------
mode : str
    "z_lift" or "gradient_lift".

field_mesh : Rhino.Geometry.Mesh
    Field mesh where both normalized fields are defined.

contours : list[Rhino.Geometry.Curve]
    Joined Phi=0 contour curves. Their polyline vertices form the candidate
    pool, and their order is used to measure spacing along each contour.

normalized_field : list[float]
    Normalized heat scalar, one value per native field_mesh vertex. This field
    controls candidate priority and the gradient direction.

normalized_width_field : list[float]
    Normalized bead-width scalar in [0, 1], one value per native field_mesh
    vertex. 0 maps to the minimum of width_range and 1 to its maximum.

width_range : Rhino.Geometry.Interval or two-value iterable
    Minimum and maximum bead width in millimeters.

overlap : float
    Allowed bead overlap in millimeters.

merge_tolerance : float
    Contour vertices closer than this value, in Rhino model units, are treated
    as duplicates.

max_count : int
    Maximum number of candidates/agents to select.

height : float
    Lift distance in Rhino model units:
        z_lift        -> world +Z distance
        gradient_lift -> tangent heat-gradient distance

Grasshopper outputs
-------------------
source_points
    Selected source points on the Phi=0 contours.

candidate_points
    Lifted endpoint corresponding to every source point.

lift_directions
    Unit vector used to generate every candidate.

candidate_values
    Normalized heat value at every selected source.

candidate_widths
    Width in millimeters associated with every candidate/target. The list is
    index-aligned with all other outputs and can be sent to the DDM component.

info
    Diagnostic summary.

Variable-width rule
-------------------
For two candidates a and b, the minimum center distance is:

    max(0, (width_a + width_b) / 2 - overlap)

This rule is applied both along each source contour and between the final
lifted endpoints. There is intentionally no static-width/static-spacing mode
in this component.
"""

import math

import Rhino
import Rhino.Geometry as rg
import numpy as np


# ============================================================
# INPUT HELPERS
# ============================================================

def parse_width_range_mm(value):
    """Return explicit (minimum, maximum) width bounds in millimeters."""

    if value is None:
        raise ValueError("width_range is missing.")

    if hasattr(value, "T0") and hasattr(value, "T1"):
        width_min = float(value.T0)
        width_max = float(value.T1)
    else:
        try:
            bounds = list(value)
        except TypeError:
            raise ValueError(
                "width_range must be a Rhino Interval or two numbers."
            )

        if len(bounds) != 2:
            raise ValueError(
                "width_range must contain exactly two numbers: min and max."
            )

        width_min = float(bounds[0])
        width_max = float(bounds[1])

    if not math.isfinite(width_min) or not math.isfinite(width_max):
        raise ValueError("width_range bounds must be finite.")

    if width_min <= 0.0 or width_max <= 0.0:
        raise ValueError("width_range bounds must be greater than zero.")

    if width_max < width_min:
        raise ValueError(
            "width_range maximum must be greater than or equal to its minimum."
        )

    return width_min, width_max


def millimeters_to_model_scale():
    """Return the scale from millimeters to the active Rhino model units."""

    document = Rhino.RhinoDoc.ActiveDoc

    if document is None:
        return 1.0, "Millimeters (no active document)"

    model_units = document.ModelUnitSystem

    scale = float(
        Rhino.RhinoMath.UnitScale(
            Rhino.UnitSystem.Millimeters,
            model_units
        )
    )

    if not math.isfinite(scale) or scale <= 0.0:
        raise ValueError(
            "Could not convert millimeters to the active Rhino model units."
        )

    return scale, str(model_units)


def minimum_center_distance(width_a, width_b, overlap_value):
    """Pairwise center spacing for full widths in matching units."""

    return max(
        0.0,
        0.5 * (float(width_a) + float(width_b)) - float(overlap_value)
    )


# ============================================================
# VALIDATE INPUTS
# ============================================================

mode_value = str(mode).strip().lower()
mode_value = mode_value.replace(" ", "_")
mode_value = mode_value.replace("-", "_")

if mode_value not in ("z_lift", "gradient_lift"):
    raise ValueError("mode must be 'z_lift' or 'gradient_lift'.")

if field_mesh is None:
    raise ValueError("field_mesh is missing.")

if field_mesh.Vertices.Count == 0:
    raise ValueError("field_mesh has no vertices.")

if field_mesh.Faces.Count == 0:
    raise ValueError("field_mesh has no faces.")


field_values = np.asarray(
    [float(value) for value in normalized_field],
    dtype=np.float64
)

if field_values.shape[0] != field_mesh.Vertices.Count:
    raise ValueError(
        "normalized_field must contain one value per field_mesh vertex. "
        "Received {}, expected {}.".format(
            field_values.shape[0],
            field_mesh.Vertices.Count
        )
    )

if not np.all(np.isfinite(field_values)):
    raise ValueError("normalized_field contains NaN or infinite values.")


width_field_values = np.asarray(
    [float(value) for value in normalized_width_field],
    dtype=np.float64
)

if width_field_values.shape[0] != field_mesh.Vertices.Count:
    raise ValueError(
        "normalized_width_field must contain one value per field_mesh vertex. "
        "Received {}, expected {}.".format(
            width_field_values.shape[0],
            field_mesh.Vertices.Count
        )
    )

if not np.all(np.isfinite(width_field_values)):
    raise ValueError(
        "normalized_width_field contains NaN or infinite values."
    )

width_tolerance = 1e-6

if (
    np.any(width_field_values < -width_tolerance)
    or np.any(width_field_values > 1.0 + width_tolerance)
):
    raise ValueError(
        "normalized_width_field values must be in [0, 1]. "
        "Observed range=({:.6f}, {:.6f}).".format(
            float(np.min(width_field_values)),
            float(np.max(width_field_values))
        )
    )

# Match lib_scalar: tolerate tiny numerical excursions, then clamp.
width_field_values = np.clip(
    width_field_values,
    0.0,
    1.0
)

width_min_mm, width_max_mm = parse_width_range_mm(width_range)

overlap_mm = float(overlap)

if not math.isfinite(overlap_mm) or overlap_mm < 0.0:
    raise ValueError("overlap must be finite and greater than or equal to zero.")

merge_tol = float(merge_tolerance)
candidate_limit = int(max_count)
lift_height = float(height)

if not math.isfinite(merge_tol) or merge_tol <= 0.0:
    raise ValueError("merge_tolerance must be finite and greater than zero.")

if candidate_limit < 0:
    raise ValueError("max_count cannot be negative.")

if not math.isfinite(lift_height) or lift_height < 0.0:
    raise ValueError("height must be finite and cannot be negative.")


if contours is None:
    raise ValueError("No contour curves were provided.")

if isinstance(contours, rg.Curve):
    contour_curves = [contours]
else:
    contour_curves = [
        curve
        for curve in list(contours)
        if curve is not None
    ]

if len(contour_curves) == 0:
    raise ValueError("No contour curves were provided.")


mm_to_model, model_unit_name = millimeters_to_model_scale()
overlap_model = overlap_mm * mm_to_model

# Linear width law from lib_scalar.normalized_width_to_mm.
field_widths_mm = (
    width_min_mm
    + width_field_values * (width_max_mm - width_min_mm)
)


# ============================================================
# TRIANGULATED ANALYSIS MESH
#
# The native field mesh vertex ordering is preserved.
# Quads are split as ABC and ACD.
# ============================================================

analysis_mesh = rg.Mesh()

for vertex in field_mesh.Vertices:
    analysis_mesh.Vertices.Add(
        float(vertex.X),
        float(vertex.Y),
        float(vertex.Z)
    )


triangle_faces = []

for face in field_mesh.Faces:
    a = int(face.A)
    b = int(face.B)
    c = int(face.C)

    analysis_mesh.Faces.AddFace(a, b, c)
    triangle_faces.append((a, b, c))

    if face.IsQuad:
        d = int(face.D)

        analysis_mesh.Faces.AddFace(a, c, d)
        triangle_faces.append((a, c, d))


vertices = np.asarray(
    [
        [
            float(vertex.X),
            float(vertex.Y),
            float(vertex.Z)
        ]
        for vertex in analysis_mesh.Vertices
    ],
    dtype=np.float64
)

faces = np.asarray(
    triangle_faces,
    dtype=np.int32
)


# ============================================================
# EXTRACT ORDERED POINTS FROM CONTOURS
# ============================================================

pool_points = []
pool_curve_indices = []
pool_curve_distances = []

curve_lengths = []
curve_closed = []

spatial_buckets = {}


def spatial_key(point):
    return (
        int(math.floor(point.X / merge_tol)),
        int(math.floor(point.Y / merge_tol)),
        int(math.floor(point.Z / merge_tol))
    )


def point_already_exists(point):
    """Test whether another pool point is within merge_tolerance."""

    key = spatial_key(point)

    for dx in (-1, 0, 1):
        for dy in (-1, 0, 1):
            for dz in (-1, 0, 1):
                neighbour = (
                    key[0] + dx,
                    key[1] + dy,
                    key[2] + dz
                )

                for index in spatial_buckets.get(neighbour, []):
                    if pool_points[index].DistanceTo(point) <= merge_tol:
                        return True

    return False


def add_pool_point(point, curve_index, distance):
    """Add one ordered contour vertex to the candidate pool."""

    if point_already_exists(point):
        return

    index = len(pool_points)

    pool_points.append(point)
    pool_curve_indices.append(curve_index)
    pool_curve_distances.append(distance)

    key = spatial_key(point)
    spatial_buckets.setdefault(key, []).append(index)


for curve_index, curve in enumerate(contour_curves):
    success, polyline = curve.TryGetPolyline()

    if not success:
        raise ValueError(
            "Contour {} is not polyline-compatible. The contours from the "
            "previous Phi component should be joined line segments.".format(
                curve_index
            )
        )

    polyline_points = [
        rg.Point3d(
            float(point.X),
            float(point.Y),
            float(point.Z)
        )
        for point in polyline
    ]

    if len(polyline_points) < 2:
        curve_lengths.append(0.0)
        curve_closed.append(False)
        continue

    is_closed = bool(curve.IsClosed)

    # Closed polylines usually repeat the first point at the end.
    if (
        is_closed
        and polyline_points[0].DistanceTo(polyline_points[-1]) <= merge_tol
    ):
        polyline_points.pop()

    # Remove consecutive zero-length segments.
    clean_points = []

    for point in polyline_points:
        if not clean_points:
            clean_points.append(point)
            continue

        if clean_points[-1].DistanceTo(point) > merge_tol:
            clean_points.append(point)

    if len(clean_points) < 2:
        curve_lengths.append(0.0)
        curve_closed.append(False)
        continue

    cumulative_distances = [0.0]

    for index in range(1, len(clean_points)):
        segment_length = clean_points[index - 1].DistanceTo(
            clean_points[index]
        )

        cumulative_distances.append(
            cumulative_distances[-1] + segment_length
        )

    total_length = cumulative_distances[-1]

    if is_closed:
        total_length += clean_points[-1].DistanceTo(clean_points[0])

    curve_lengths.append(total_length)
    curve_closed.append(is_closed)

    for point, distance in zip(clean_points, cumulative_distances):
        add_pool_point(
            point=point,
            curve_index=curve_index,
            distance=distance
        )


if len(pool_points) == 0:
    raise ValueError("No candidate points could be extracted from contours.")


# ============================================================
# VECTOR HELPERS
# ============================================================

def normalize_rows(vectors):
    output = np.asarray(vectors, dtype=np.float64).copy()

    lengths = np.linalg.norm(output, axis=1)
    valid = lengths > 1e-12

    output[valid] /= lengths[valid, None]
    output[~valid] = 0.0

    return output


def fallback_tangent(normal):
    normal = np.asarray(normal, dtype=np.float64)

    normal_length = float(np.linalg.norm(normal))

    if normal_length <= 1e-12:
        normal = np.array([0.0, 0.0, 1.0], dtype=np.float64)
    else:
        normal = normal / normal_length

    reference = np.array([1.0, 0.0, 0.0], dtype=np.float64)

    if abs(float(np.dot(reference, normal))) > 0.9:
        reference = np.array([0.0, 1.0, 0.0], dtype=np.float64)

    tangent = np.cross(reference, normal)
    tangent_length = float(np.linalg.norm(tangent))

    if tangent_length <= 1e-12:
        return np.array([1.0, 0.0, 0.0], dtype=np.float64)

    return tangent / tangent_length


# ============================================================
# CALCULATE PER-VERTEX TANGENT HEAT GRADIENT
#
# gradient_lift moves toward increasing normalized_field.
# ============================================================

def compute_vertex_tangent_directions():
    vertex_count = vertices.shape[0]

    v0 = vertices[faces[:, 0]]
    v1 = vertices[faces[:, 1]]
    v2 = vertices[faces[:, 2]]

    face_cross = np.cross(v1 - v0, v2 - v0)
    double_area = np.linalg.norm(face_cross, axis=1)
    valid_faces = double_area > 1e-12

    face_normals = np.zeros_like(face_cross)
    face_normals[valid_faces] = (
        face_cross[valid_faces] / double_area[valid_faces, None]
    )

    # Area-weighted vertex normals.
    vertex_normals_output = np.zeros(
        (vertex_count, 3),
        dtype=np.float64
    )

    for column in range(3):
        np.add.at(
            vertex_normals_output,
            faces[:, column],
            face_cross
        )

    vertex_normals_output = normalize_rows(vertex_normals_output)

    invalid_normals = (
        np.linalg.norm(vertex_normals_output, axis=1) <= 1e-12
    )

    vertex_normals_output[invalid_normals] = np.array(
        [0.0, 0.0, 1.0],
        dtype=np.float64
    )

    scalar_0 = field_values[faces[:, 0]]
    scalar_1 = field_values[faces[:, 1]]
    scalar_2 = field_values[faces[:, 2]]

    # Piecewise-linear scalar gradient on every triangle.
    face_gradients = np.zeros(
        (faces.shape[0], 3),
        dtype=np.float64
    )

    face_gradients[valid_faces] = (
        scalar_0[valid_faces, None]
        * np.cross(
            face_normals[valid_faces],
            v2[valid_faces] - v1[valid_faces]
        )
        + scalar_1[valid_faces, None]
        * np.cross(
            face_normals[valid_faces],
            v0[valid_faces] - v2[valid_faces]
        )
        + scalar_2[valid_faces, None]
        * np.cross(
            face_normals[valid_faces],
            v1[valid_faces] - v0[valid_faces]
        )
    ) / double_area[valid_faces, None]

    face_area = 0.5 * double_area

    vertex_gradients = np.zeros(
        (vertex_count, 3),
        dtype=np.float64
    )

    vertex_weights = np.zeros(vertex_count, dtype=np.float64)

    for column in range(3):
        indices = faces[:, column]

        np.add.at(
            vertex_gradients,
            indices,
            face_gradients * face_area[:, None]
        )

        np.add.at(vertex_weights, indices, face_area)

    valid_weights = vertex_weights > 1e-12
    vertex_gradients[valid_weights] /= vertex_weights[valid_weights, None]

    # Project the gradient onto each mesh tangent plane.
    tangent_directions = (
        vertex_gradients
        - np.sum(
            vertex_gradients * vertex_normals_output,
            axis=1,
            keepdims=True
        ) * vertex_normals_output
    )

    tangent_directions = normalize_rows(tangent_directions)

    invalid_tangents = (
        np.linalg.norm(tangent_directions, axis=1) <= 1e-12
    )

    for index in np.flatnonzero(invalid_tangents):
        tangent_directions[index] = fallback_tangent(
            vertex_normals_output[index]
        )

    return tangent_directions, vertex_normals_output


vertex_tangents = None
vertex_normals = None

if mode_value == "gradient_lift":
    vertex_tangents, vertex_normals = (
        compute_vertex_tangent_directions()
    )


# ============================================================
# SAMPLE FIELD DATA AT AN ARBITRARY CONTOUR POINT
# ============================================================

def closest_mesh_data(point):
    mesh_point = analysis_mesh.ClosestMeshPoint(point, 0.0)

    if mesh_point is None:
        raise RuntimeError(
            "Could not project a contour point to field_mesh."
        )

    face = analysis_mesh.Faces[mesh_point.FaceIndex]

    indices = np.asarray(
        [int(face.A), int(face.B), int(face.C)],
        dtype=np.int32
    )

    weights = np.asarray(
        [
            float(mesh_point.T[0]),
            float(mesh_point.T[1]),
            float(mesh_point.T[2])
        ],
        dtype=np.float64
    )

    return indices, weights


def sample_tangent(point):
    indices, weights = closest_mesh_data(point)

    tangent = np.sum(
        vertex_tangents[indices] * weights[:, None],
        axis=0
    )

    normal = np.sum(
        vertex_normals[indices] * weights[:, None],
        axis=0
    )

    normal_length = float(np.linalg.norm(normal))

    if normal_length <= 1e-12:
        normal = np.array([0.0, 0.0, 1.0], dtype=np.float64)
    else:
        normal = normal / normal_length

    # Re-project after barycentric interpolation.
    tangent = tangent - float(np.dot(tangent, normal)) * normal
    tangent_length = float(np.linalg.norm(tangent))

    if tangent_length <= 1e-12:
        tangent = fallback_tangent(normal)
    else:
        tangent = tangent / tangent_length

    return tangent


# Sample both scalar fields with the same barycentric coordinates.
pool_values = []
pool_widths_mm = []

for point in pool_points:
    sample_indices, sample_weights = closest_mesh_data(point)

    pool_values.append(
        float(np.sum(field_values[sample_indices] * sample_weights))
    )

    pool_widths_mm.append(
        float(np.sum(field_widths_mm[sample_indices] * sample_weights))
    )

pool_widths_model = [
    width_mm * mm_to_model
    for width_mm in pool_widths_mm
]


# ============================================================
# SELECT CANDIDATES WITH VARIABLE-WIDTH CONTOUR SPACING
#
# 1. Select the available point with minimum heat value.
# 2. Block same-contour points closer than the pairwise width rule.
# 3. Repeat until max_count is reached.
# ============================================================

valid = [True for point in pool_points]
selected = []


while len(selected) < candidate_limit:
    valid_indices = [
        index
        for index, is_valid in enumerate(valid)
        if is_valid
    ]

    if len(valid_indices) == 0:
        break

    selected_index = min(
        valid_indices,
        key=lambda index: (pool_values[index], index)
    )

    selected.append(selected_index)
    valid[selected_index] = False

    selected_curve_index = pool_curve_indices[selected_index]
    selected_curve_distance = pool_curve_distances[selected_index]
    total_curve_length = curve_lengths[selected_curve_index]

    for other_index in valid_indices:
        if not valid[other_index]:
            continue

        if pool_curve_indices[other_index] != selected_curve_index:
            continue

        contour_distance = abs(
            pool_curve_distances[other_index] - selected_curve_distance
        )

        if curve_closed[selected_curve_index]:
            contour_distance = min(
                contour_distance,
                total_curve_length - contour_distance
            )

        threshold = minimum_center_distance(
            pool_widths_model[selected_index],
            pool_widths_model[other_index],
            overlap_model
        )

        # Match lib_scalar: equality with the threshold is allowed.
        if contour_distance < threshold:
            valid[other_index] = False


# ============================================================
# GENERATE LIFTED CANDIDATES
# ============================================================

# OUTPUT: Selected source points on the Phi=0 contours.
source_points = []

# OUTPUT: Lifted endpoint for every source point.
candidate_points = []

# OUTPUT: Unit vector used to generate every candidate.
lift_directions = []

# OUTPUT: Normalized heat value at every source point.
candidate_values = []

# OUTPUT: Width in millimeters for every candidate/target.
candidate_widths = []


for selected_index in selected:
    source = pool_points[selected_index]

    if mode_value == "z_lift":
        direction = np.array([0.0, 0.0, 1.0], dtype=np.float64)
    else:
        direction = sample_tangent(source)

    candidate = rg.Point3d(
        source.X + lift_height * float(direction[0]),
        source.Y + lift_height * float(direction[1]),
        source.Z + lift_height * float(direction[2])
    )

    source_points.append(source)
    candidate_points.append(candidate)

    lift_directions.append(
        rg.Vector3d(
            float(direction[0]),
            float(direction[1]),
            float(direction[2])
        )
    )

    candidate_values.append(float(pool_values[selected_index]))
    candidate_widths.append(float(pool_widths_mm[selected_index]))


# ============================================================
# VARIABLE-WIDTH ENDPOINT SPACING RULE
#
# Greedily keep endpoints whose Euclidean 3D distance from every previously
# kept endpoint is at least the pairwise variable-width threshold.
# ============================================================

selected_before_endpoint_spacing = len(candidate_points)
keep_indices = []

for candidate_index, endpoint in enumerate(candidate_points):
    if not keep_indices:
        keep_indices.append(candidate_index)
        continue

    remove_endpoint = False

    for kept_index in keep_indices:
        kept_endpoint = candidate_points[kept_index]
        endpoint_distance = endpoint.DistanceTo(kept_endpoint)

        threshold = minimum_center_distance(
            candidate_widths[kept_index] * mm_to_model,
            candidate_widths[candidate_index] * mm_to_model,
            overlap_model
        )

        if endpoint_distance < threshold:
            remove_endpoint = True
            break

    if not remove_endpoint:
        keep_indices.append(candidate_index)


endpoint_spacing_removed = (
    selected_before_endpoint_spacing - len(keep_indices)
)


# Filter every associated output using the same indices.
source_points = [source_points[index] for index in keep_indices]
candidate_points = [candidate_points[index] for index in keep_indices]
lift_directions = [lift_directions[index] for index in keep_indices]
candidate_values = [candidate_values[index] for index in keep_indices]
candidate_widths = [
    candidate_widths[index]
    for index in keep_indices
]


if candidate_widths:
    selected_width_summary = "{:.3f}..{:.3f}".format(
        min(candidate_widths),
        max(candidate_widths)
    )
else:
    selected_width_summary = "n/a"


# OUTPUT: Diagnostic summary.
info = (
    "mode={} | "
    "width_mode=field | "
    "contours={} | "
    "available_vertices={} | "
    "selected_before_endpoint_spacing={} | "
    "endpoint_spacing_removed={} | "
    "selected={} | "
    "width_range_mm={:.3f}..{:.3f} | "
    "selected_widths_mm={} | "
    "overlap_mm={:.3f} | "
    "model_units={} | "
    "height={} | "
    "tangent_sign=+1"
).format(
    mode_value,
    len(contour_curves),
    len(pool_points),
    selected_before_endpoint_spacing,
    endpoint_spacing_removed,
    len(source_points),
    width_min_mm,
    width_max_mm,
    selected_width_summary,
    overlap_mm,
    model_unit_name,
    lift_height
)
# ---------- end variable_width_candidate_generation ----------

# ----
target_orient = Python3Script(
    print_candidates=variable_width_candidate_generation.candidate_points,
    target_directions=variable_width_candidate_generation.lift_directions,
    cone_max_tilt_deg=number_slider_5,
    clamp_to_cone=toggle)  # -> out, candidates, clamped_directions, info; inputs print_candidates: list, target_directions: list, cone_max_tilt_deg: Double, clamp_to_cone: Boolean
# ---------- target_orient: Python ----------
# venv: heatmethod
"""
Clamp target orientations to a cone around world +Z.

Grasshopper Python 3 inputs:
    print_candidates
        List Access.
        Candidate points. Their positions are never modified.

    target_directions
        List Access.
        Orientation vector associated with each candidate.

    clamp_to_cone
        Item Access, Boolean.
        If True, orientations outside the cone are clamped.
        If False, orientations are only normalized.

    cone_max_tilt_deg
        Item Access, Number.
        Maximum permitted tilt from world +Z, in degrees.
        The original pipeline uses 45 degrees by default.

Grasshopper outputs:
    candidates
        Original candidate points, unchanged.

    clamped_directions
        Unit orientation vectors after applying the cone constraint.

    info
        Processing summary.
"""

import math
import Rhino.Geometry as rg


EPSILON = 1.0e-12
CONE_AXIS = rg.Vector3d(0.0, 0.0, 1.0)


def as_list(value):
    """Convert a Grasshopper List Access input to a Python list."""
    if value is None:
        return []

    if isinstance(value, (rg.Point3d, rg.Vector3d)):
        return [value]

    try:
        return list(value)
    except TypeError:
        return [value]


def to_vector3d(value):
    """Convert common Grasshopper vector representations to Vector3d."""
    if isinstance(value, rg.Vector3d):
        return rg.Vector3d(value)

    try:
        return rg.Vector3d(
            float(value.X),
            float(value.Y),
            float(value.Z)
        )
    except AttributeError:
        return rg.Vector3d(
            float(value[0]),
            float(value[1]),
            float(value[2])
        )


def dot(a, b):
    """Return the dot product of two Vector3d values."""
    return (
        a.X * b.X +
        a.Y * b.Y +
        a.Z * b.Z
    )


def normalized_or_world_z(value):
    """
    Normalize a direction.

    A zero-length input is replaced with world +Z, matching the
    fallback behavior of the original target-orientation pipeline.
    """
    direction = to_vector3d(value)
    length = direction.Length

    if length <= EPSILON:
        return rg.Vector3d(CONE_AXIS), True

    direction.X /= length
    direction.Y /= length
    direction.Z /= length

    return direction, False


def clamp_direction_to_cone(value, max_tilt_degrees):
    """
    Clamp one direction to a cone around world +Z.

    The cone angle is measured from its central axis, so 45 degrees
    permits orientations between 0 and 45 degrees from world +Z.
    """
    direction, used_fallback = normalized_or_world_z(value)

    maximum_angle = max(
        0.0,
        min(float(max_tilt_degrees), 179.9)
    )

    maximum_angle_radians = math.radians(maximum_angle)
    cos_maximum = math.cos(maximum_angle_radians)
    sin_maximum = math.sin(maximum_angle_radians)

    axial_component = dot(direction, CONE_AXIS)

    # Direction is already inside the permitted cone.
    if axial_component >= cos_maximum:
        return direction, False, used_fallback

    # Component perpendicular to the cone axis.
    perpendicular = rg.Vector3d(
        direction.X - axial_component * CONE_AXIS.X,
        direction.Y - axial_component * CONE_AXIS.Y,
        direction.Z - axial_component * CONE_AXIS.Z
    )

    perpendicular_length = perpendicular.Length

    if perpendicular_length <= EPSILON:
        # Deterministic fallback perpendicular to the cone axis.
        reference = rg.Vector3d(1.0, 0.0, 0.0)

        if abs(dot(reference, CONE_AXIS)) > 0.9:
            reference = rg.Vector3d(0.0, 1.0, 0.0)

        perpendicular = rg.Vector3d.CrossProduct(
            CONE_AXIS,
            reference
        )
        perpendicular_length = perpendicular.Length

    perpendicular.X /= max(perpendicular_length, EPSILON)
    perpendicular.Y /= max(perpendicular_length, EPSILON)
    perpendicular.Z /= max(perpendicular_length, EPSILON)

    result = rg.Vector3d(
        cos_maximum * CONE_AXIS.X + sin_maximum * perpendicular.X,
        cos_maximum * CONE_AXIS.Y + sin_maximum * perpendicular.Y,
        cos_maximum * CONE_AXIS.Z + sin_maximum * perpendicular.Z
    )

    if result.Length <= EPSILON:
        result = rg.Vector3d(CONE_AXIS)
    else:
        result.Unitize()

    return result, True, used_fallback


# ----------------------------------------------------------------------
# Inputs
# ----------------------------------------------------------------------

candidate_list = as_list(print_candidates)
direction_list = as_list(target_directions)

enabled = (
    bool(clamp_to_cone)
    if clamp_to_cone is not None
    else False
)

maximum_tilt = (
    float(cone_max_tilt_deg)
    if cone_max_tilt_deg is not None
    else 45.0
)

if len(candidate_list) != len(direction_list):
    raise ValueError(
        "print_candidates and target_directions must have the same "
        "number of items. Got {} candidates and {} directions.".format(
            len(candidate_list),
            len(direction_list)
        )
    )


# ----------------------------------------------------------------------
# Clamp orientations
# ----------------------------------------------------------------------

candidates = list(candidate_list)
clamped_directions = []

clamped_count = 0
fallback_count = 0

for direction_value in direction_list:

    if enabled:
        result, was_clamped, used_fallback = clamp_direction_to_cone(
            direction_value,
            maximum_tilt
        )
    else:
        result, used_fallback = normalized_or_world_z(direction_value)
        was_clamped = False

    clamped_directions.append(result)

    if was_clamped:
        clamped_count += 1

    if used_fallback:
        fallback_count += 1


# ----------------------------------------------------------------------
# Information
# ----------------------------------------------------------------------

info = (
    "Candidates: {}\n"
    "Clamp enabled: {}\n"
    "Maximum tilt: {:.3f} degrees\n"
    "Directions clamped: {}\n"
    "Zero directions replaced with +Z: {}"
).format(
    len(candidates),
    enabled,
    max(0.0, min(maximum_tilt, 179.9)),
    clamped_count,
    fallback_count
)
# ---------- end target_orient ----------
pl = PlaneNormal(Origin=target_orient.candidates, ZAxis=target_orient.clamped_directions)

# ---- group: DDS Representation (continued)
dds_profile = Python3Script(width=variable_width_candidate_generation.candidate_widths, height=addition_2)  # -> out, Profile; inputs width: Double, height: Double
# ---------- dds_profile: Python ----------
# venv: dds
# DDS Profile
# Inputs: width, height
# Outputs: Profile
#
# - width and height use the same units as the Domain and Target coordinates.
# - Profile describes the nominal bead cross-section used by all deposits wired
#   to it.
# - Targets are top/nozzle-referenced. The GH helpers do not expose
#   center-reference conversion.

from dds.gh_helpers.components import make_bead_profile

Profile = None

try:
    Profile = make_bead_profile(width, height)
    print("Profile:", Profile.width, "x", Profile.height)
except Exception as exc:
    print("Profile creation failed:", repr(exc))
# ---------- end dds_profile ----------

dds_compose_target = Python3Script(Position=target_orient.candidates, Normal=target_orient.clamped_directions)  # -> out, Target; inputs Position: Point3d, Normal: Vector3d
# ---------- dds_compose_target: Python ----------
# venv: dds
# DDS Compose Target
# Inputs: Position, Normal
# Outputs: Target
#
# - Position can be a Rhino point, Rhino plane/frame, or an existing DDS target.
# - If Position is a plane/frame, its origin and normal define the target and
#   the Normal input is ignored.
# - If Position is a point and Normal is empty, DDS uses world +Z.
# - Target is the only orientation carrier for point/line/polyline deposits.

from dds.gh_helpers.components import make_target

Target = None

try:
    Target = make_target(Position, normal=Normal)
    print("Target:", Target.position.to_tuple(), Target.normal.to_tuple())
except Exception as exc:
    print("Target creation failed:", repr(exc))
# ---------- end dds_compose_target ----------
dds_point_deposit = Python3Script(Target=dds_compose_target.Target, Profile=dds_profile.Profile)  # -> out, Deposit
# ---------- dds_point_deposit: Python ----------
# venv: dds
# DDS Point Deposit
# Inputs: Target, Profile
# Outputs: Deposit
#
# - Target can be a DDS target, Rhino plane/frame, or Rhino point.
# - If Target is a point, world +Z is used as its normal.
# - The deposit represents one bead centered below the top/nozzle-referenced
#   target according to Profile.height.

from dds.gh_helpers.components import make_point_deposit

Deposit = None

try:
    Deposit = make_point_deposit(Target, Profile)
    print("PointDeposit created")
except Exception as exc:
    print("Point deposit failed:", repr(exc))
# ---------- end dds_point_deposit ----------

dds_simulate = Python3Script(Domain=dds_domain.Domain, Deposits=dds_point_deposit.Deposit, run=Toggle(True), reset=Button())  # -> out, Result; inputs Deposits: list
# ---------- dds_simulate: Python ----------
# venv: dds
# DDS Simulate
# Inputs: Domain, Deposits, run, reset, include_coverage
# Outputs: Result
#
# - Deposits should use List Access and may receive one or many deposit objects.
# - run gates the expensive dense-field computation. Keep it False while
#   editing sliders, then set True when you want a result.
# - reset clears the optional sticky result cache used by dds.gh_helpers.
# - include_coverage=True computes an additive overlap diagnostic. Keep it
#   False for normal mesh preview.
# - threshold is fixed to 0.5 in this template for a simpler GH UI.
# - The output Result is immutable; recomputing does not append duplicate
#   deposits.

from dds.gh_helpers.components import run_simulation

Result = None

try:
    Result = run_simulation(
        Domain,
        Deposits,
        run=run,
        reset=reset,
        threshold=0.5,
    )
    if Result is None:
        print("Simulation ready. Set run=True to compute.")
    else:
        print("Simulation deposits:", len(Result.deposits))
except Exception as exc:
    print("Simulation failed:", repr(exc))
# ---------- end dds_simulate ----------
dds_mesh = Python3Script(Result=dds_simulate.Result)  # -> out, Mesh
# ---------- dds_mesh: Python ----------
# venv: dds
# DDS Mesh
# Inputs: Result, threshold, step_size
# Outputs: Mesh
#
# - Mesh extraction runs marching cubes on Result.implicit_field.
# - This requires scikit-image in Rhino's Python environment.
# - threshold defaults to the Result threshold when empty.
# - step_size=1 gives best quality. Larger values, such as 2 or 3, are faster
#   preview meshes.
# - Grasshopper/Rhino handles display; DDS does not import PyVista or PySide.

from dds.gh_helpers.components import make_mesh

Mesh = None

try:
    if Result is None:
        print("No Result input.")
    else:
        Mesh = make_mesh(
            Result,
            threshold=None,
            step_size=1,
        )
        print("Mesh created")
except Exception as exc:
    print("Mesh extraction failed:", repr(exc))
# ---------- end dds_mesh ----------
dds_mesh_2 = Mesh(dds_mesh.Mesh)

# ---- group: Simulate Loop / Stop Loop Conditions
null = NullItem(Item=variable_width_candidate_generation.candidate_points)  # -> NullFlags, InvalidFlags, Description
lng_2 = ListLength(List=variable_width_candidate_generation.candidate_points)
equals = Equality(FirstNumber=lng_2, SecondNumber="0")  # -> Equality, Inequality
mm = MassMultiplication(Input=null.NullFlags)  # -> Result, PartialResults
nor = GateNor(A=equals.Equality, B=mm.Result)
and = GateAnd(A=nor, B=run_loop)

# ---- group: Simulate Loop (continued)
state_writer = Python3Script(new_beads=dds_mesh_2, new_target_planes=pl, run=and, reset=reset_loop, max_iterations=number_slider_7, loop_id=panel_5)  # -> out, stored_mesh, iteration, running, info, log; inputs new_beads: Mesh, new_target_planes: list of Plane, run: Boolean, reset: Boolean, max_iterations: Int32, loop_id: String
# ---------- state_writer: Python ----------
# venv: heatmethod
"""
Persistent bead and target-plane state writer.

Inputs:
    new_beads
        List Access, Mesh.
        Bead meshes generated during the current iteration only.

    new_target_planes
        List Access, Plane.
        One target plane per bead generated during the current iteration.
        Each plane contributes its Origin and Z axis to the persistent log.

    run
        Boolean Toggle.
        Keep True to continue iterating.

    reset
        Boolean button shared with the Reader.

    max_iterations
        Maximum number of complete iterations.

    loop_id
        Text identifier shared with the Reader.

Outputs:
    stored_beads
        Complete list of accumulated bead meshes.

    current_mesh
        Combined scan and accumulated bead geometry.

    iteration
        Number of completed iterations.

    running
        True while more iterations are pending.

    info
        Compact current-state information.

    log
        Complete plane history grouped by iteration.
"""

import Rhino.Geometry as rg
import scriptcontext as sc
import Grasshopper


STATE_VERSION = 3
EPSILON = 1.0e-12


def duplicate_mesh(mesh):
    """Duplicate a Rhino mesh to avoid sharing mutable references."""
    if mesh is None:
        return None

    return mesh.DuplicateMesh()


def as_list(value):
    """Convert a Grasshopper List Access input to a Python list."""
    if value is None:
        return []

    if isinstance(value, (rg.Mesh, rg.Plane)):
        return [value]

    try:
        return list(value)
    except TypeError:
        return [value]


def as_mesh_list(value):
    """Validate and return a clean list of Rhino meshes."""
    meshes = []

    for item in as_list(value):
        if item is None:
            continue

        if not hasattr(item, "DuplicateMesh"):
            raise TypeError(
                "Every item in new_beads must be a Rhino Mesh."
            )

        meshes.append(item)

    return meshes


def unwrap_plane(value):
    """Convert a Grasshopper or Rhino plane value to Rhino.Geometry.Plane."""
    if isinstance(value, rg.Plane):
        return rg.Plane(value)

    if hasattr(value, "Value") and isinstance(value.Value, rg.Plane):
        return rg.Plane(value.Value)

    raise TypeError(
        "Every item in new_target_planes must be a Rhino Plane."
    )


def plane_to_record(value):
    """
    Store only the immutable Origin and Z values from a target plane.

    Numeric tuples are safer to retain in sticky than mutable geometry.
    """
    plane = unwrap_plane(value)

    origin = plane.Origin
    z_axis = rg.Vector3d(plane.ZAxis)

    if z_axis.Length <= EPSILON:
        z_axis = rg.Vector3d(0.0, 0.0, 1.0)
    else:
        z_axis.Unitize()

    return {
        "origin": (
            float(origin.X),
            float(origin.Y),
            float(origin.Z)
        ),
        "z": (
            float(z_axis.X),
            float(z_axis.Y),
            float(z_axis.Z)
        )
    }


def as_plane_records(value):
    """Convert the current iteration plane list to persistent records."""
    records = []

    for item in as_list(value):
        if item is not None:
            records.append(
                plane_to_record(item)
            )

    return records


def get_state_key(identifier):
    """Build the shared sticky key."""
    text = str(identifier).strip() if identifier is not None else ""

    if not text:
        text = "default_dds_loop"

    return "BEHAV3D_SCAN_BEADS_PLANES_V3::" + text


def combine_meshes(scan, beads):
    """Append scan and bead meshes without performing a Boolean union."""
    combined = rg.Mesh()
    geometry_added = False

    if scan is not None:
        combined.Append(scan)
        geometry_added = True

    for bead in beads:
        if bead is not None:
            combined.Append(bead)
            geometry_added = True

    if not geometry_added:
        return None

    combined.Normals.ComputeNormals()
    combined.Compact()

    return combined


def format_plane(record):
    """Format one stored target plane for the text log."""
    origin = record["origin"]
    z_axis = record["z"]

    return (
        "O({:.3f}, {:.3f}, {:.3f}) "
        "Z({:.4f}, {:.4f}, {:.4f})"
    ).format(
        origin[0],
        origin[1],
        origin[2],
        z_axis[0],
        z_axis[1],
        z_axis[2]
    )


def build_log(state):
    """Build the complete target-plane history."""
    if state is None:
        return "No state available."

    history = state.get("plane_history", [])
    total_beads = int(state.get("total_beads", 0))

    lines = [
        "TARGET PLANE LOG",
        "Completed iterations: {}".format(
            int(state.get("iteration", 0))
        ),
        "Total beads: {}".format(total_beads),
        ""
    ]

    if not history:
        lines.append("No target planes stored.")
        return "\n".join(lines)

    for iteration_record in history:
        iteration_number = int(iteration_record["iteration"])
        planes = iteration_record.get("planes", [])

        lines.append(
            "Iteration {} | Planes / beads: {}".format(
                iteration_number,
                len(planes)
            )
        )

        for index, plane_record in enumerate(planes):
            lines.append(
                "  {}. {}".format(
                    index + 1,
                    format_plane(plane_record)
                )
            )

        lines.append("")

    return "\n".join(lines).rstrip()


STATE_KEY = get_state_key(loop_id)


def schedule_reader_solution(state):
    """Schedule the next solution by expiring the Reader component."""
    document = ghenv.Component.OnPingDocument()
    reader_guid = state.get("reader_guid")

    if document is None:
        return False, "Grasshopper document not found."

    if not reader_guid:
        return False, "Reader GUID not found."

    if state.get("scheduled", False):
        return True, "Next solution already scheduled."

    state["scheduled"] = True

    def callback(gh_document):
        current_state = sc.sticky.get(STATE_KEY)

        if current_state is None:
            return

        current_state["scheduled"] = False
        target_guid = current_state.get("reader_guid")

        for document_object in gh_document.Objects:
            if str(document_object.InstanceGuid) == str(target_guid):
                document_object.ExpireSolution(False)
                return

    schedule_delegate = (
        Grasshopper.Kernel.GH_Document.GH_ScheduleDelegate(callback)
    )

    document.ScheduleSolution(1, schedule_delegate)

    return True, "Next solution scheduled."


state = sc.sticky.get(STATE_KEY)
action = "Waiting."


if state is None or state.get("version") != STATE_VERSION:
    action = (
        "State not found. Solve the Reader first and confirm that both "
        "components use the same loop_id."
    )

elif bool(reset):
    state["running"] = False
    state["scheduled"] = False
    action = "Reset active. Nothing was appended."

else:
    state.setdefault("plane_history", [])
    state.setdefault("total_beads", 0)

    maximum = (
        max(1, int(max_iterations))
        if max_iterations is not None
        else 100
    )

    current_iteration = int(state.get("iteration", 0))
    run_enabled = bool(run)

    if not run_enabled:
        state["running"] = False
        action = "Paused. Set run to True to continue."

    elif current_iteration >= maximum:
        state["running"] = False
        action = "Maximum iteration count reached."

    elif state.get("scheduled", False):
        state["running"] = True
        action = "Waiting for the scheduled solution."

    else:
        incoming_beads = as_mesh_list(new_beads)
        incoming_planes = as_plane_records(new_target_planes)

        if not incoming_beads:
            state["running"] = False
            action = "No valid new bead meshes received."

        elif not incoming_planes:
            state["running"] = False
            action = "No valid target planes received."

        else:
            stored_list = state.setdefault("bead_meshes", [])

            # Store the bead geometry from this iteration exactly once.
            for bead in incoming_beads:
                stored_list.append(
                    duplicate_mesh(bead)
                )

            new_iteration = current_iteration + 1

            # One target plane represents one logical bead.
            state["plane_history"].append({
                "iteration": new_iteration,
                "planes": incoming_planes
            })

            state["total_beads"] += len(incoming_planes)
            state["iteration"] = new_iteration

            state["running"] = (
                run_enabled and
                new_iteration < maximum
            )

            scheduled, schedule_message = schedule_reader_solution(state)

            if scheduled:
                action = (
                    "Stored {} bead mesh(es) and {} target plane(s). {}"
                ).format(
                    len(incoming_beads),
                    len(incoming_planes),
                    schedule_message
                )
            else:
                state["running"] = False
                action = (
                    "Iteration stored, but refresh failed. " +
                    schedule_message
                )


if state is None or state.get("version") != STATE_VERSION:
    stored_beads = []
    current_mesh = None
    iteration = 0
    running = False
    stored_mesh_count = 0
    total_bead_count = 0

else:
    stored_beads = [
        duplicate_mesh(mesh)
        for mesh in state.get("bead_meshes", [])
        if mesh is not None
    ]

    current_mesh = combine_meshes(
        state.get("scan_mesh"),
        stored_beads
    )

    iteration = int(state.get("iteration", 0))
    running = bool(state.get("running", False))
    stored_mesh_count = len(stored_beads)
    total_bead_count = int(state.get("total_beads", 0))


info = (
    "Loop ID: {}\n"
    "Iteration: {}\n"
    "Running: {}\n"
    "Stored bead meshes: {}\n"
    "Total beads: {}\n"
    "{}"
).format(
    loop_id,
    iteration,
    running,
    stored_mesh_count,
    total_bead_count,
    action
)

log = build_log(state)
# ---------- end state_writer ----------

# ---- group: Visualize beads per cycle
split_3 = SplitList(List=state_reader.bead_meshes, Index=preview_cycles)  # -> ListA, ListB
material = CreateMaterial(Diffuse=RGB(255, 255, 255), Specular=RGB(255, 255, 255), Emission=RGB(0, 0, 0), Transparency=0, Shine=0)
preview_4 = CustomPreview(Geometry=split_3.ListA, Material=material)
