# Grasshopper definition G03_A02_beads.gh (Grasshopper 1.0.8)
# plug-ins: Heteroptera, Robots, MeshEdit Components, Pufferfish, Human, Bifocals, MetaHopper

# ----
# CLICK TO EXPORT YAML
# DIRECTORY
# FOLDER
# FILENAME
panel = Panel("C:\Users\sofiefda\OneDrive - NTNU\PhD\05 Courses\Experimental Architecture\Turtorials\T02 Discrete Deposition\")

list = RobotsLibrary({"UR3e", "UR5e", "UR10e", "UR16e", "UR3", "UR5", "UR10", "UR20", "UR30"}, selected="UR20", Type=0)
loadrobot = LoadRobotSystem(Name=list, Base=PlaneXY(0, 0, 0))

ram_extruder = Mesh(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)
extruder_tcp = Plane(Plane(origin=(475.2540852, 0, 80.95937734), x=(0, -1, 0), y=(0, 0, 1)))

# ----
# YAML
# EXPORT
panel_2 = Panel("G03_alt_28.yaml")

# ----
# GEOMETRY
# TO
# FIT TO MESH
# Mesh
# Location
panel_3 = Panel("C:\Users\sofiefda\OneDrive - NTNU\PhD\05 Courses\Experimental Architecture\Turtorials\T02 Discrete Deposition\")

rotate = Rotate(Geometry=ram_extruder, Angle=-1.570796327, Plane=PlaneXY(0, 0, 0))  # -> Geometry, Transform
tool = CreateTool(Name="DefaultGHTool", TCP=extruder_tcp, Weight=0, Mesh=rotate.Geometry)  # -> Tool, TCP

# ----
# CLICK TO EXPORT YAML
# DIRECTORY
# FOLDER
# FILENAME
panel_4 = Panel("C:\Users\sofiefda\OneDrive - NTNU\PhD\05 Courses\Experimental Architecture\Turtorials\T02 Discrete Deposition\")  # disabled

list_2 = RobotsLibrary({"UR3e", "UR5e", "UR10e", "UR16e", "UR3", "UR5", "UR10", "UR20", "UR30"}, selected="UR20", Type=0)  # disabled
loadrobot_2 = LoadRobotSystem(Name=list_2, Base=PlaneXY(0, 0, 0))  # disabled

ram_extruder_2 = Mesh(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)  # disabled
extruder_tcp_2 = Plane(Plane(origin=(475.2540852, 0, 80.95937734), x=(0, -1, 0), y=(0, 0, 1)))  # disabled

# ----
# CLICK ME TO SIMULATE
button = Button()

# ----
# CLICK ME TO LOAD DDS
button_2 = Button()

# ----
# Mesh
# Location
panel_5 = Panel("250")
neg = Negative(Value=panel_5)
neg_2 = Negative(Value="250")
concat = Concatenate(FragmentA=neg, FragmentB=" to ", FragmentC=panel_5)
concat_2 = Concatenate(FragmentA=neg_2, FragmentB=" to ", FragmentC="200")

# ----
# YAML
# EXPORT
panel_6 = Panel("G03_hgt_12.yaml")  # disabled
button_3 = Button()  # disabled

wiredisplay = ControlWireDisplay(WireDisplay=2, AllObjects_Object=[table_center_2, rectangle_7, panel_13, panel_14, move_12, Z_13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])

rotate_2 = Rotate(Geometry=ram_extruder_2, Angle=-1.570796327, Plane=PlaneXY(0, 0, 0))  # -> Geometry, Transform; disabled
tool_2 = CreateTool(Name="DefaultGHTool", TCP=extruder_tcp_2, Weight=0, Mesh=rotate_2.Geometry)  # -> Tool, TCP; disabled

# ----
# CLICK ME TO SIMULATE
button_4 = Button()  # disabled

# ----
# CLICK ME TO LOAD DDS
button_5 = Button()  # disabled

wiredisplay_2 = ControlWireDisplay(WireDisplay=2, AllObjects_Object=[table_center_2, rectangle_7, panel_13, panel_14, move_12, Z_13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])  # disabled

pt = Point(Point(575.0524213, 950.5693585, 0))
Z = UnitZ(Factor=Slider(0, range=0..100))
sph = Sphere(Base=pt, Radius=Slider(220, range=0..1000))
move = Move(Geometry=pt, Motion=Z)  # -> Geometry, Transform
rectangle = Rectangle(Plane=move.Geometry, XSize="-500 to 500", YSize="-500 to 500", Radius=0)  # -> Rectangle, Length
panel_7 = Panel("""500
-500""")
split = SplitBrep(Brep=sph, Cutter=rectangle.Rectangle)
X = UnitX(Factor=panel_7)
move_2 = Move(Geometry=pt, Motion=X)  # -> Geometry, Transform
item = ListItem(List=split, Index=0, Wrap=True)
pline = PolyLine(Vertices=move_2.Geometry, Closed=False)
number_slider = Slider(147, range=0..1000)
number_slider_2 = Slider(99, range=0..100)
panel_8 = Panel("""20
-20""")
neg_3 = Negative(Value=number_slider)
rotate_3 = Rotate(Geometry=pline, Angle=degrees(panel_8), Plane=pt)  # -> Geometry, Transform
merge = Merge(Data1=number_slider, Data2=neg_3)
panel_9 = Panel("""60
-60""")
Y = UnitY(Factor=merge)
move_3 = Move(Geometry=graft(rotate_3.Geometry), Motion=graft(Y))  # -> Geometry, Transform
Z_2 = UnitZ(Factor=Slider(300, range=0..1000))
extr = Extrude(Base=flatten(move_3.Geometry), Direction=Z_2)
item_2 = ListItem(List=extr, Index=0, Wrap=True)  # -> Item, Item1
split_2 = SplitBrep(Brep=item, Cutter=item_2.Item)
item_3 = ListItem(List=flatten(split_2), Index=0, Wrap=True)
split_3 = SplitBrep(Brep=item_3, Cutter=item_2.Item1)
item_4 = ListItem(List=flatten(split_3), Index=Slider(1, range=0..1), Wrap=True)
geo = Geometry(item_4)
scale_nu = ScaleNU(Geometry=geo, Plane=pt, ScaleX=Slider(0.6, range=0..1), ScaleY=Slider(0.4, range=0..1), ScaleZ=1)  # -> Geometry, Transform

# ----
# Mesh Processing
concat_3 = Concatenate(FragmentA=panel_3, FragmentB="tsdf_surface_mesh.stl")
_3dm = Import3DM(File=concat_3, Layer="*", Name="*")
area = MeshArea(Mesh=_3dm)  # -> Area, Centroid
sort = SortList(Keys=area.Area, ValuesA=_3dm)  # -> Keys, reverse(ValuesA)
item_5 = ListItem(List=sort.ValuesA, Index=0, Wrap=True)
mesh = Mesh(item_5)
scale = Scale(Geometry=mesh, Center=Point(0, 0, 0), Factor=Slider(1000, range=0..1000))  # -> Geometry, Transform
rotate_4 = Rotate(Geometry=scale.Geometry, Angle=degrees(Slider(180, range=0..1000)), Plane=PlaneXY(0, 0, 0))  # -> Geometry, Transform
center = Center(Geometry=rotate_4.Geometry)  # -> Center, Dimension
rectangle_2 = Rectangle(Plane=center.Center, XSize=concat_2, YSize=concat, Radius=0)  # -> Rectangle, Length
Z_3 = UnitZ(Factor=Slider(20, range=0..100))
move_4 = Move(Geometry=rectangle_2.Rectangle, Motion=Z_3)  # -> Geometry, Transform
panel_10 = Panel("""-20
20""")
Z_4 = UnitZ(Factor=Slider(100, range=0..100))
extr_2 = Extrude(Base=move_4.Geometry, Direction=expr("x*-1", Z_4))
Z_5 = UnitZ(Factor=panel_10)
mesh_2 = Mesh(extr_2)
move_5 = Move(Geometry=center.Center, Motion=Z_5)  # -> Geometry, Transform
msplit = MeshSplit(Mesh=rotate_4.Geometry, Splitters=mesh_2)
pline_2 = PolyLine(Vertices=move_5.Geometry, Closed=False)
mcx = MeshCurve(Mesh=msplit, Curve=pline_2)  # -> Points, Faces
null = NullItem(Item=mcx.Points)  # -> flatten(NullFlags), InvalidFlags, Description
dispatch = Dispatch(List=msplit, DispatchPattern=null.NullFlags)  # -> ListA, ListB
geo_2 = Geometry(dispatch.ListB)
medges = MeshEdges(Mesh=geo_2)  # -> NakedEdges, InteriorEdges, NonManifoldEdges
end = EndPoints(Curve=medges.InteriorEdges)  # -> Start, End
patch = Patch(Points=end.Start, Spans=Slider(20, range=0..100), Flexibility=Slider(0.1, range=0..0.1), Trim=True)
srf = Surface(patch)
surface_generator = Python3Script(
    base_surface=srf,
    divU=panel_5,
    divV="250",
    lift=Slider(0, range=0..100),
    make_mesh=Toggle(True),
    mesh_mode=Slider(1, range=0..100),
    run=Toggle(True))  # -> out_points, out_grid, out_mesh, out_uv, dbg; inputs base_surface: Surface, divU: Int32, divV: Int32, lift: Double
# ---------- surface_generator: Python ----------
import Rhino.Geometry as rg
import rhinoscriptsyntax as rs
import Rhino
import System

# Inputs expected in GH:
#   base_surface (trimmed BrepFace or Brep or guid)
#   divU (int)
#   divV (int)
#   lift (float)           # optional, along face normal
#   make_mesh (bool)       # optional
#   mesh_mode (str/int)    # "tri" or "quad" (or 0=tri, 1=quad)
#   run (bool)

# ------------------------------------------------------------
# Helpers: unwrap/coerce BrepFace
# ------------------------------------------------------------
def coerce_face(x):
    g = getattr(x, "Geometry", x)

    try:
        if isinstance(g, System.Guid):
            g = rs.coercebrep(g) or rs.coercesurface(g)
    except:
        pass

    if g is None:
        return None

    if isinstance(g, rg.Brep):
        if g.Faces.Count == 0:
            return None
        return g.Faces[0]

    if isinstance(g, rg.BrepFace):
        return g

    if isinstance(g, rg.Surface):
        b = rg.Brep.CreateFromSurface(g)
        if b and b.Faces.Count > 0:
            return b.Faces[0]
        return None

    return None

def parse_mesh_mode(m):
    # returns "tri" or "quad"
    if m is None:
        return "tri"
    if isinstance(m, str):
        s = m.strip().lower()
        if "quad" in s:
            return "quad"
        return "tri"
    try:
        return "quad" if int(m) == 1 else "tri"
    except:
        return "tri"

# ------------------------------------------------------------
# Main
# ------------------------------------------------------------
out_points = []
out_grid = []
out_mesh = None
out_uv = []
dbg = ""

if not run:
    dbg = "run is False"
else:
    face = coerce_face(base_surface)
    if face is None:
        dbg = "ERROR: base_surface is not a BrepFace/Brep/Surface (or could not be coerced)"
    else:
        divU = int(divU)
        divV = int(divV)

        uCount = max(2, divU + 1)
        vCount = max(2, divV + 1)

        dom_u = face.Domain(0)
        dom_v = face.Domain(1)
        du = float(dom_u.T1 - dom_u.T0)
        dv = float(dom_v.T1 - dom_v.T0)

        if du == 0.0 or dv == 0.0:
            dbg = "ERROR: face domain is degenerate"
        else:
            mode = parse_mesh_mode(mesh_mode)

            vidx = [[-1 for _ in range(uCount)] for __ in range(vCount)]
            out_grid = [[None for _ in range(uCount)] for __ in range(vCount)]

            lift_val = float(lift) if lift is not None else 0.0
            keep_count = 0
            skip_count = 0

            mesh = rg.Mesh() if make_mesh else None

            # Sample only the trimmed region using IsPointOnFace(u,v)
            for v_i in range(vCount):
                vn = float(v_i) / float(vCount - 1) if vCount > 1 else 0.0
                v = dom_v.T0 + vn * dv

                for u_i in range(uCount):
                    un = float(u_i) / float(uCount - 1) if uCount > 1 else 0.0
                    u = dom_u.T0 + un * du

                    rel = face.IsPointOnFace(u, v)
                    if rel == rg.PointFaceRelation.Exterior:
                        skip_count += 1
                        continue

                    p = face.PointAt(u, v)

                    if lift_val != 0.0:
                        n = face.NormalAt(u, v)
                        if n.IsTiny():
                            n = rg.Vector3d(0, 0, 1)
                        else:
                            n.Unitize()
                        p = rg.Point3d(p.X + n.X * lift_val,
                                      p.Y + n.Y * lift_val,
                                      p.Z + n.Z * lift_val)

                    out_grid[v_i][u_i] = p
                    out_points.append(p)
                    out_uv.append(rg.Point2d(u, v))
                    keep_count += 1

                    if mesh is not None:
                        vid = mesh.Vertices.Add(p)
                        vidx[v_i][u_i] = vid

            # Build faces from valid grid cells only
            face_count = 0
            if mesh is not None:
                for v_i in range(vCount - 1):
                    for u_i in range(uCount - 1):
                        a = vidx[v_i][u_i]
                        b = vidx[v_i][u_i + 1]
                        c = vidx[v_i + 1][u_i + 1]
                        d = vidx[v_i + 1][u_i]

                        # Require all corners inside trims
                        if a < 0 or b < 0 or c < 0 or d < 0:
                            continue

                        if mode == "quad":
                            # one quad per cell
                            mesh.Faces.AddFace(a, b, c, d)
                            face_count += 1
                        else:
                            # two triangles per cell
                            mesh.Faces.AddFace(a, b, c)
                            mesh.Faces.AddFace(a, c, d)
                            face_count += 2

                if mesh.Faces.Count > 0:
                    mesh.Normals.ComputeNormals()
                    mesh.Compact()
                    out_mesh = mesh

            dbg = "OK: grid {}x{} kept:{} skipped:{} mesh_mode:{} mesh_faces:{}".format(
                uCount, vCount, keep_count, skip_count, mode, (out_mesh.Faces.Count if out_mesh else 0)
            )
# ---------- end surface_generator ----------
msplit_2 = MeshSplit(Mesh=surface_generator.out_mesh, Splitters=mesh_2)
mcx_2 = MeshCurve(Mesh=msplit_2, Curve=pline_2)  # -> Points, Faces
null_2 = NullItem(Item=mcx_2.Points)  # -> flatten(NullFlags), InvalidFlags, Description
dispatch_2 = Dispatch(List=msplit_2, DispatchPattern=null_2.NullFlags)  # -> ListA, ListB

panel_11 = Panel("C:\Users\sofiefda\Documents\Experimental Architecture\3DP-DDS-main\src\")
dds_setup = Python3Script(run=button_2, package_path=panel_11)  # -> out, DDSPath; inputs run: Boolean, package_path: String
# ---------- dds_setup: Python ----------
# venv: dds
# DDS Setup
# Inputs: package_path, run
# Outputs: DDSPath
# r: numpy==2.0.2, scipy==1.13.1, scikit-image==0.24.0
#
# - package_path points at the repository `src` folder, not the repository root.
# - Use a Button for run. The path is stored in scriptcontext.sticky so it
#   remains available after the button releases.
# - This only points Rhino Python at DDS source code. It does not install
#   runtime dependencies such as numpy, scipy, or scikit-image.
# - DDSPath should resolve to `.../3DP-DDS/src/dds/__init__.py`; any other path
#   means Rhino is importing a different DDS copy.

import sys
import scriptcontext as sc

KEY = "dds.gh_helpers.source_path"

if run and package_path:
    sc.sticky[KEY] = package_path

DDS_SRC = sc.sticky.get(KEY, package_path)

if DDS_SRC and DDS_SRC not in sys.path:
    sys.path.insert(0, DDS_SRC)

OK = False
DDSPath = None

if DDS_SRC:
    try:
        import dds
        import dds.gh_helpers

        DDSPath = dds.__file__
        if bool(DDSPath and DDSPath.startswith(DDS_SRC)):
            print("DDS loaded from:", DDSPath)
        else:
            print("DDS imported from unexpected path:", DDSPath)
    except Exception as exc:
        DDSPath = None
        print("DDS setup failed:", repr(exc))
else:
    print("Press run with package_path set to the DDS src folder.")
# ---------- end dds_setup ----------

panel_12 = Panel("C:\Users\sofiefda\Documents\Experimental Architecture\3DP-DDS-main\src\")  # disabled
dds_setup_2 = Python3Script(run=button_5, package_path=panel_12)  # -> out, DDSPath; inputs run: Boolean, package_path: String; disabled; same code as dds_setup

# ----
# Bead Height
# Exploration
# Grid
# Dimensions
number_slider_3 = Slider(217, range=0..1000)
number_slider_4 = Slider(105, range=0..1000)

# ----
# Starting Bead
# Height
# Added
# Height
number_slider_5 = Slider(5, range=0..10)

# ----
# Grid
# Division
number_slider_6 = Slider(1, range=0..10)

# ----
# Added
# Layers
number_slider_7 = Slider(2, range=0..10)

controlbox_center = Point(Point(-1243.688337, -331.9089097, -930))
table_center = Point(Point(-5.611449167, 956.0239308, -930))

panel_13 = Panel("-1000 to 1000")  # disabled
panel_14 = Panel("-400 to 400")  # disabled
panel_15 = Panel("-300 to 300")  # disabled
panel_16 = Panel("-200 to 200")  # disabled
controlbox_center_2 = Point(Point(-1243.688337, -331.9089097, -930))  # disabled
table_center_2 = Point(Point(-5.611449167, 956.0239308, -930))  # disabled

smoothed_mesh = Geometry(dispatch_2.ListB)
addition = Addition(A=number_slider_6, B="1")

medges_2 = MeshEdges(Mesh=smoothed_mesh)  # -> NakedEdges, InteriorEdges, NonManifoldEdges
preview = CustomPreview(Geometry=rotate_4.Geometry, Material=ColourSwatch(SwatchColor=RGBA(51, 51, 51, 176)))
preview_2 = CustomPreview(Geometry=smoothed_mesh, Material=ColourSwatch(SwatchColor=RGBA(27, 59, 13, 80)))
previewlw = CustomPreviewLineweights(
    Geometry=medges_2.NakedEdges,
    Shader=ColourSwatch(SwatchColor=RGB(88, 191, 44)),
    Thickness=Slider(5, range=0..10),
    Absolute=False)

# ----
# ROBOT
# VISUALIZATION
swatch = ColourSwatch(SwatchColor=RGBA(44, 159, 191, 248))

medges_3 = MeshEdges(Mesh=smoothed_mesh)  # -> NakedEdges, InteriorEdges, NonManifoldEdges; disabled
number_slider_8 = Slider(5, range=0..10)  # disabled
swatch_2 = ColourSwatch(SwatchColor=RGB(88, 191, 44))  # disabled
swatch_3 = ColourSwatch(SwatchColor=RGBA(27, 59, 13, 80))  # disabled
swatch_4 = ColourSwatch(SwatchColor=RGBA(51, 51, 51, 176))  # disabled
preview_3 = CustomPreview(Geometry=rotate_4.Geometry, Material=swatch_4)  # disabled
preview_4 = CustomPreview(Geometry=smoothed_mesh, Material=swatch_3)  # disabled
previewlw_2 = CustomPreviewLineweights(Geometry=medges_3.NakedEdges, Shader=swatch_2, Thickness=number_slider_8, Absolute=False)  # disabled

# ----
# ROBOT
# VISUALIZATION
swatch_5 = ColourSwatch(SwatchColor=RGBA(44, 159, 191, 248))  # disabled
swatch_6 = ColourSwatch(SwatchColor=RGBA(0, 0, 0, 160))  # disabled

addition_2 = Addition(A=number_slider_6, B="1")

# ----
# WARNINGS
# ERRORS
number_slider_9 = Slider(0.9166, range=0..1)

# ----
# WARNINGS
# ERRORS
number_slider_10 = Slider(0.6656, range=0..1)  # disabled

# ----
# ROBOT
# SIMULATION
panel_17 = Panel("-1.5708,-1.5708,2.0944,0,1.5708,pi")
frame = CreateFrame(Plane=PlaneXY(0, 0, 0), CoupledMechanicalGroup=-1, CoupledMechanism=-1, Name="base")
frame_2 = CreateFrame(Plane=PlaneXY(0, 0, 0), CoupledMechanicalGroup=-1, CoupledMechanism=-1)
number_slider_11 = Slider(100, range=0..1000)
list_3 = ValueList({"Joint", "Linear"}, selected="Linear")
wait = Wait(Time=Slider(5, range=0..10))
createtarget = CreateTarget(Joints=panel_17, Tool=tool.Tool, Speed=Slider(75, range=0..1000), Zone="0", Frame=frame, IsCartesian=False)
data = Data(number_slider_9)

crv = Curve(<curve referenced from the Rhino model>)
Z_6 = UnitZ(Factor=Slider(21, range=0..1000))
move_6 = Move(Geometry=crv, Motion=Z_6)  # -> Geometry, Transform
center_2 = Center(Geometry=move_6.Geometry)  # -> Center, Dimension
scale_nu_2 = ScaleNU(
    Geometry=move_6.Geometry,
    Plane=center_2.Center,
    ScaleX=Slider(0.55, range=0..1),
    ScaleY=Slider(0.6, range=0..1),
    ScaleZ=1)  # -> Geometry, Transform
Y_2 = UnitY(Factor=Slider(0, range=0..100))
move_7 = Move(Geometry=scale_nu_2.Geometry, Motion=Y_2)  # -> Geometry, Transform
move_8 = Move(Geometry=move_7.Geometry, Motion=Z_6)  # -> Geometry, Transform
center_3 = Center(Geometry=move_8.Geometry)  # -> Center, Dimension
scale_nu_3 = ScaleNU(
    Geometry=move_8.Geometry,
    Plane=center_3.Center,
    ScaleX=Slider(0.9, range=0..1),
    ScaleY=Slider(0.75, range=0..1),
    ScaleZ=1)  # -> Geometry, Transform
Y_3 = UnitY(Factor=Slider(0, range=0..100))
neg_4 = Negative(Value=Y_3)

center_4 = Center(Geometry=scale_nu_3.Geometry)  # -> Center, Dimension
xz = XZPlane(Origin=center_4.Center)
mirror = Mirror(Geometry=scale_nu_3.Geometry, Plane=xz)  # -> Geometry, Transform

move_9 = Move(Geometry=mirror.Geometry, Motion=neg_4)  # -> Geometry, Transform
loft = Loft(
    Curves=[crv, move_7.Geometry, move_9.Geometry],
    Options={Adjust=True, Closed=False, LoftEnds=0, LoftSimp=0, LoftType=0, Rebuild=10, Refit=0.01})

input_geometry = Geometry(loft)

panel_18 = Panel("base")  # disabled
# ROBOT
# SIMULATION
panel_19 = Panel("-1.5708,-1.5708,2.0944,0,1.5708,pi")  # disabled
number_slider_12 = Slider(5, range=0..10)  # disabled
frame_3 = CreateFrame(Plane=PlaneXY(0, 0, 0), CoupledMechanicalGroup=-1, CoupledMechanism=-1, Name=panel_18)  # disabled
frame_4 = CreateFrame(Plane=PlaneXY(0, 0, 0), CoupledMechanicalGroup=-1, CoupledMechanism=-1)  # disabled
number_slider_13 = Slider(100, range=0..1000)  # disabled
number_slider_14 = Slider(75, range=0..1000)  # disabled
list_4 = ValueList({"Joint", "Linear"}, selected="Linear")  # disabled
wait_2 = Wait(Time=number_slider_12)  # disabled
panel_20 = Panel("0")  # disabled
createtarget_2 = CreateTarget(Joints=panel_19, Tool=tool_2.Tool, Speed=number_slider_14, Zone=panel_20, Frame=frame_3, IsCartesian=False)  # disabled
number_slider_15 = Slider(1, range=0..10)  # disabled
panel_21 = Panel("UR_20")  # disabled
data_2 = Data(number_slider_10)  # disabled

folder_name = Data(panel)
file_name = Data(panel_2)
concat_4 = Concatenate(FragmentA=folder_name, FragmentB=file_name)

folder_name_2 = Data(panel_4)  # disabled
file_name_2 = Data(panel_6)  # disabled
toggle = BooleanToggle(False)  # disabled
concat_5 = Concatenate(FragmentA=folder_name_2, FragmentB=file_name_2)  # disabled

number_slider_16 = Slider(28, range=0..100)  # disabled

number_slider_17 = Slider(2, range=0.1..2)  # disabled

neg_5 = Negative(Value=number_slider_4)
dom = ConstructDomain(DomainStart=neg_5, DomainEnd=number_slider_3)
addition_3 = Addition(A=number_slider_4, B=number_slider_3)
rectangle_3 = Rectangle(Plane=PlaneXY(0, 0, 0), XSize=dom, YSize=dom, Radius=0)  # -> Rectangle, Length
series = Series(Start=Slider(14, range=0..100), Step=number_slider_5, Count=addition)  # -> reverse(Series)
division = Division(A=addition_3, B=number_slider_6)
grid = GridInRectangle(Rectangle=rectangle_3.Rectangle, Size=division)  # -> Points, U, V
bbox = BoundingBox(Content=flatten(grid.Points), Plane=PlaneXY(0, 0, 0), UnionBox=True)  # -> Box, Box_2
center_5 = Center(Geometry=bbox.Box, referenceAll=2)  # -> Center, Dimension
multiplication = Multiplication(A=series, B=number_slider_7)
pt_2 = ConstructPoint(XCoordinate=0, YCoordinate=0, ZCoordinate=0)
Z_7 = UnitZ(Factor=series)
Z_8 = UnitZ(Factor=multiplication)
move_10 = Move(Geometry=pt_2, Motion=Z_8)  # -> Geometry, Transform
ln = Line(StartPoint=pt_2, EndPoint=move_10.Geometry)  # -> graft(Line)
len = Length(Curve=ln)
division_2 = Division(A=len, B=number_slider_7)

panel_22 = Panel(series)

# ---- group: GRAFT BY Z
geo_3 = Geometry(flatten(grid.Points))
deconstruct = Deconstruct(Point=geo_3)  # -> XComponent, YComponent, ZComponent
graft_list_by_same_value = GraftListBySameValue(list=geo_3, number=flatten(deconstruct.XComponent))

# ----
data_3 = Data(flatten(division_2))

rectangle_4 = Rectangle(Plane=controlbox_center, XSize="-300 to 300", YSize="-200 to 200", Radius=0)  # -> Rectangle, Length
rectangle_5 = Rectangle(Plane=table_center, XSize="-1000 to 1000", YSize="-400 to 400", Radius=0)  # -> Rectangle, Length
number_slider_18 = Slider(720, range=0..1000)
Z_9 = UnitZ(Factor=number_slider_18)
move_11 = Move(Geometry=rectangle_5.Rectangle, Motion=Z_9)  # -> Geometry, Transform
Z_10 = UnitZ(Factor=Slider(600, range=0..1000))
srf_2 = Surface(rectangle_4.Rectangle)
number_slider_19 = Slider(20, range=0..100)
extr_3 = Extrude(Base=srf_2, Direction=Z_10)
Z_11 = UnitZ(Factor=number_slider_19)
srf_3 = Surface(move_11.Geometry)
scale_nu_4 = ScaleNU(Geometry=move_11.Geometry, Plane=table_center, ScaleX=Slider(0.92, range=0..1), ScaleY=Slider(0.8, range=0..1), ScaleZ=1)  # -> Geometry, Transform
extr_4 = Extrude(Base=srf_3, Direction=Z_11)
disc = Discontinuity(Curve=scale_nu_4.Geometry, Level=1)  # -> Points, Parameters
cir = Circle(Plane=disc.Points, Radius=Slider(15, range=0..100))
srf_4 = Surface(cir)
subtraction = Subtraction(A=number_slider_18, B=number_slider_19)
Z_12 = UnitZ(Factor=expr("-X", subtraction))
extr_5 = Extrude(Base=srf_4, Direction=Z_12)

table_surface = Geometry(extr_4)
control_box = Geometry(extr_3)
robot_base = Geometry(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)
table_legs = Geometry(extr_5)

edges = BrepEdges(Brep=[robot_base, table_surface, table_legs, control_box])  # -> Naked, Interior, NonManifold
# WORKCELL
# VISUALIZATION
previewlw_3 = CustomPreviewLineweights(
    Geometry=edges.Interior,
    Shader=ColourSwatch(SwatchColor=RGB(54, 54, 54)),
    Thickness=Slider(3, range=0..10),
    Absolute=False)
preview_5 = CustomPreview(Geometry=robot_base, Material=ColourSwatch(SwatchColor=RGB(255, 255, 255)))
preview_6 = CustomPreview(Geometry=[table_surface, control_box], Material=ColourSwatch(SwatchColor=RGBA(166, 166, 166, 160)))
preview_7 = CustomPreview(Geometry=table_legs, Material=ColourSwatch(SwatchColor=RGB(59, 59, 59)))

rectangle_6 = Rectangle(Plane=controlbox_center_2, XSize=panel_15, YSize=panel_16, Radius=0)  # -> Rectangle, Length; disabled
rectangle_7 = Rectangle(Plane=table_center_2, XSize=panel_13, YSize=panel_14, Radius=0)  # -> Rectangle, Length; disabled
number_slider_20 = Slider(720, range=0..1000)  # disabled
number_slider_21 = Slider(600, range=0..1000)  # disabled
Z_13 = UnitZ(Factor=number_slider_20)  # disabled
move_12 = Move(Geometry=rectangle_7.Rectangle, Motion=Z_13)  # -> Geometry, Transform; disabled
Z_14 = UnitZ(Factor=number_slider_21)  # disabled
number_slider_22 = Slider(0.92, range=0..1)  # disabled
number_slider_23 = Slider(0.8, range=0..1)  # disabled
srf_5 = Surface(rectangle_6.Rectangle)  # disabled
number_slider_24 = Slider(20, range=0..100)  # disabled
extr_6 = Extrude(Base=srf_5, Direction=Z_14)  # disabled
Z_15 = UnitZ(Factor=number_slider_24)  # disabled
srf_6 = Surface(move_12.Geometry)  # disabled
scale_nu_5 = ScaleNU(Geometry=move_12.Geometry, Plane=table_center_2, ScaleX=number_slider_22, ScaleY=number_slider_23, ScaleZ=1)  # -> Geometry, Transform; disabled
extr_7 = Extrude(Base=srf_6, Direction=Z_15)  # disabled
disc_2 = Discontinuity(Curve=scale_nu_5.Geometry, Level=1)  # -> Points, Parameters; disabled
number_slider_25 = Slider(15, range=0..100)  # disabled
cir_2 = Circle(Plane=disc_2.Points, Radius=number_slider_25)  # disabled
srf_7 = Surface(cir_2)  # disabled
subtraction_2 = Subtraction(A=number_slider_20, B=number_slider_24)  # disabled
Z_16 = UnitZ(Factor=expr("-X", subtraction_2))  # disabled
extr_8 = Extrude(Base=srf_7, Direction=Z_16)  # disabled
number_slider_26 = Slider(3, range=0..10)  # disabled
swatch_7 = ColourSwatch(SwatchColor=RGB(54, 54, 54))  # disabled
swatch_8 = ColourSwatch(SwatchColor=RGB(255, 255, 255))  # disabled
swatch_9 = ColourSwatch(SwatchColor=RGBA(166, 166, 166, 160))  # disabled
swatch_10 = ColourSwatch(SwatchColor=RGB(59, 59, 59))  # disabled

table_surface_2 = Geometry(extr_7)  # disabled
control_box_2 = Geometry(extr_6)  # disabled
robot_base_2 = Geometry(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)  # disabled
table_legs_2 = Geometry(extr_8)  # disabled

edges_2 = BrepEdges(Brep=[robot_base_2, table_surface_2, table_legs_2, control_box_2])  # -> Naked, Interior, NonManifold; disabled
# WORKCELL
# VISUALIZATION
previewlw_4 = CustomPreviewLineweights(Geometry=edges_2.Interior, Shader=swatch_7, Thickness=number_slider_26, Absolute=False)  # disabled
preview_8 = CustomPreview(Geometry=robot_base_2, Material=swatch_8)  # disabled
preview_9 = CustomPreview(Geometry=[table_surface_2, control_box_2], Material=swatch_9)  # disabled
preview_10 = CustomPreview(Geometry=table_legs_2, Material=swatch_10)  # disabled

# ----
# Orient Object
# To Table Mesh
facen = FaceNormals(Mesh=smoothed_mesh)  # -> Centers, Normals
avr = Average(Input=facen.Normals)
avr_2 = Average(Input=facen.Centers)
bbox_2 = BoundingBox(Content=flatten(input_geometry), Plane=PlaneXY(0, 0, 0), UnionBox=True)  # -> Box, Box_2
pl = PlaneNormal(Origin=avr_2, ZAxis=avr)
prot = RotatePlane(Plane=pl, Angle=degrees(Slider(90, range=0..100)))
center_6 = Center(Geometry=bbox_2.Box, referenceAll=2)  # -> Center, Dimension
flippln = FlipPlane(Plane=prot, FlipX=invert(False), FlipY=invert(False), FlipZ=invert(True))  # -> Flipped, R

pflip = FlipPlane(Plane=flippln.Flipped, ReverseX=invert(False), ReverseY=invert(False), SwapAxes=True)

orient = Orient(Geometry=input_geometry, Source=center_6.Center, Target=pflip)  # -> Geometry, Transform

oriented_geometry = Geometry(orient.Geometry)

orient_2 = Orient(Geometry=graft_list_by_same_value, Source=center_5.Center, Target=flippln.Flipped)  # -> Geometry, Transform
geo_4 = Geometry(orient_2.Geometry)

toggle_2 = BooleanToggle(True)  # disabled

number_slider_27 = Slider(7, range=0..10)

# ----
# TARGETS
# VISUALIZATION
number_slider_28 = Slider(25, range=0..100)

number_slider_29 = Slider(7, range=0..10)  # disabled
number_slider_30 = Slider(1518, range=0..10000)  # disabled
number_slider_31 = Slider(5, range=0..10)  # disabled
swatch_11 = ColourSwatch(SwatchColor=RGBA(133, 133, 133, 248))  # disabled

# ----
# TARGETS
# VISUALIZATION
number_slider_32 = Slider(25, range=0..100)  # disabled
swatch_12 = ColourSwatch(SwatchColor=RGB(255, 0, 0))  # disabled
swatch_13 = ColourSwatch(SwatchColor=RGB(0, 68, 255))  # disabled
swatch_14 = ColourSwatch(SwatchColor=RGB(0, 255, 4))  # disabled

swatch_15 = ColourSwatch(SwatchColor=RGB(145, 127, 118))  # disabled

move_13 = Move(Geometry=simplify(geo_4), Motion=graft(Z_7))  # -> Geometry, Transform
orient_3 = Orient(Geometry=ln, Source=PlaneXY(0, 0, 0), Target=move_13.Geometry)  # -> Geometry, Transform
midpt = CurveMiddle(Curve=orient_3.Geometry)
divide = DivideCurve(Curve=orient_3.Geometry, Count=number_slider_7, Kinks=False)  # -> simplify(Points), Tangents, Parameters
tag = TextTag3D(Location=midpt, Text=division_2, Size=Slider(25, range=0..100), Justification=7)

# ---- group: GRAFT BY Z
geo_5 = Geometry(flatten(divide.Points))
deconstruct_2 = Deconstruct(Point=geo_5)  # -> XComponent, YComponent, ZComponent
graft_list_by_same_value_2 = GraftListBySameValue(list=geo_5, number=flatten(deconstruct_2.YComponent))

# ----
# Bead Generation
deplane = DeconstructPlane(Plane=flippln.Flipped)  # -> Origin, XAxis, YAxis, ZAxis
contour = Contour(Shape=oriented_geometry, Point=flippln.Flipped, Direction=deplane.ZAxis, Distance=Slider(14, range=0..100))  # -> flatten(Contours)
number_slider_33 = Slider(15, range=0..100)
bead_height = Data(Slider(14, range=0..100))

cull_i = CullIndex(List=reverse(flatten(contour)), Indices=Slider(0, range=0..100), Wrap=True)

dispatch_3 = Dispatch(List=flatten(cull_i), DispatchPattern=[True, False])  # -> ListA, ListB
divdist = DivideDistance(Curve=dispatch_3.ListA, Distance=number_slider_33)  # -> Points, Tangents, Parameters
divdist_2 = DivideDistance(Curve=dispatch_3.ListB, Distance=number_slider_33)  # -> Points, Tangents, Parameters
dispatch_4 = Dispatch(List=divdist.Points, DispatchPattern=[True, False])  # -> ListA, ListB
dispatch_5 = Dispatch(List=divdist_2.Points, DispatchPattern=[True, False])  # -> ListA, ListB
geo_6 = Geometry(dispatch_4.ListA)
geo_7 = Geometry(dispatch_5.ListB)
merge_2 = Merge(Data1=geo_6, Data2=geo_7)

ddm_planes = Plane(merge_2)

ddm_planes_2 = Plane(flatten(ddm_planes))

# ----
# DDS
# LOADING
ddm_planes_3 = Plane(flatten(ddm_planes_2))

# ----
# INPUT
# GEOMETRY
ddm_planes_4 = Plane(flatten(ddm_planes_3))

createtarget_3 = CreateTarget(Plane=ddm_planes_4, Motion=list_3, Tool=tool.Tool, Speed=number_slider_11, Frame=frame_2, IsCartesian=True)
createtarget_4 = CreateTarget(Plane=ddm_planes_4, Motion=list_3, Tool=tool.Tool, Speed=number_slider_11, Command=wait, Frame=frame_2, IsCartesian=True)
weave = Weave(Pattern=[0, 1], Stream0=createtarget_3, Stream1=createtarget_4, NullGaps=False)
panel_23 = Panel(createtarget_3)
merge_3 = Merge(Data1=createtarget, Data2=weave, Data3=createtarget)
program = CreateProgram(Name="UR_20", RobotSystem=loadrobot, Targets=merge_3, StepSize=Slider(1, range=0..10))  # -> Program, Code, Duration, Warnings, Errors
sim = ProgramSimulation(Program=program.Program, Time=data, Normalized=True)  # -> SystemMeshes, JointRotations, Plane, Index, Time, Program, Errors

panel_24 = Panel(program.Warnings)
panel_25 = Panel(program.Errors)

ddm_planes_5 = Plane(ddm_planes_4)

py3 = Python3Script(planes=flatten(ddm_planes_5), include_approach=Toggle(False), save_file=Button(), file_path=concat_4)  # -> yaml_line_out, count_out, status_out; inputs planes: list of Plane
# ---------- py3: Python ----------
"""
Planes → YAML writer (index + "O(...) Z(...)" line)

Rhino 8 (GH Python) compatible.

Inputs:
    planes     : list of Rhino.Geometry.Plane
    save_file  : boolean toggle
    file_path  : string

Outputs:
    yaml_out       : full YAML as string
    yaml_line_out  : YAML as list of lines
    count_out      : number of planes exported
    status_out     : export status message
"""

import Rhino
import os

# -----------------------------
# Units conversion (doc → meters)
# -----------------------------
doc = Rhino.RhinoDoc.ActiveDoc
doc_units = doc.ModelUnitSystem if doc else Rhino.UnitSystem.Millimeters
to_m = Rhino.RhinoMath.UnitScale(doc_units, Rhino.UnitSystem.Meters)

def _unitize(v):
    vv = Rhino.Geometry.Vector3d(v)
    vv.Unitize()
    return vv

def _fmt2(x):
    return "%.2f" % float(x)

def _origin_str_mm(o):
    # Your example numbers look like mm, so keep ORIGIN in document units (likely mm).
    # If you actually want meters, multiply by to_m here.
    return "O(%s,%s,%s)" % (_fmt2(o.X), _fmt2(o.Y), _fmt2(o.Z))

def _zaxis_str(z):
    zu = _unitize(z)
    return "Z(%s,%s,%s)" % (_fmt2(zu.X), _fmt2(zu.Y), _fmt2(zu.Z))

def make_yaml(planes_in):
    lines = ["targets:"]
    valid_planes = [p for p in planes_in if p is not None]

    for i, pl in enumerate(valid_planes):
        o = pl.Origin
        z = pl.ZAxis

        lines.append("  - index: %d" % i)
        lines.append("    plane: \"%s %s\"" % (_origin_str_mm(o), _zaxis_str(z)))

    return lines, len(valid_planes)

# -----------------------------
# Run safely
# -----------------------------
yaml_line_out, yaml_out, count_out, status_out = [], "", 0, ""

try:
    if planes is None:
        planes = []
    if file_path is None:
        file_path = ""

    yaml_line_out, count_out = make_yaml(list(planes))
    yaml_out = "\n".join(yaml_line_out)

    if count_out == 0:
        status_out = "No valid planes exported."
    else:
        status_out = "Prepared %d plane(s)." % count_out

    if save_file and file_path:
        try:
            folder = os.path.dirname(file_path)
            if folder and not os.path.exists(folder):
                os.makedirs(folder)
            with open(file_path, "w", encoding="utf-8") as f:
                f.write(yaml_out)
            status_out = "Saved YAML to: %s" % file_path
        except TypeError:
            with open(file_path, "w") as f:
                f.write(yaml_out)
            status_out = "Saved YAML to: %s" % file_path
        except Exception as e:
            status_out = "Could not save file: %s" % e

except Exception as e:
    yaml_line_out = ["# ERROR: %s" % e]
    yaml_out = "# ERROR: %s" % e
    count_out = 0
    status_out = "ERROR: %s" % e
# ---------- end py3 ----------
# YAML
# EXPORTER
# YAML
# EXPORTER
panel_26 = Panel(py3.yaml_line_out)

deplane_2 = DeconstructPlane(Plane=ddm_planes_4)  # -> Origin, XAxis, YAxis, ZAxis
multiplication_2 = Multiplication(A=deplane_2.YAxis, B=number_slider_28)
multiplication_3 = Multiplication(A=deplane_2.ZAxis, B=number_slider_28)
multiplication_4 = Multiplication(A=deplane_2.XAxis, B=number_slider_28)
vdisex = VectorDisplayEx(Point=deplane_2.Origin, Vector=multiplication_3, Colour=ColourSwatch(SwatchColor=RGB(0, 68, 255)), Width=2)
vdisex_2 = VectorDisplayEx(Point=deplane_2.Origin, Vector=multiplication_4, Colour=ColourSwatch(SwatchColor=RGB(255, 0, 0)), Width=2)
vdisex_3 = VectorDisplayEx(Point=deplane_2.Origin, Vector=multiplication_2, Colour=ColourSwatch(SwatchColor=RGB(0, 255, 4)), Width=2)

item_6 = ListItem(List=sim.SystemMeshes, Index=number_slider_27, Wrap=True)
cull_i_2 = CullIndex(List=sim.SystemMeshes, Indices=number_slider_27, Wrap=True)
trail = SimpleTrail(Program=sim.Program, Length=Slider(1518, range=0..10000), MechanicalGroup=0)
previewlw_5 = CustomPreviewLineweights(Geometry=trail, Shader=swatch, Thickness=Slider(5, range=0..10), Absolute=False)
preview_11 = CustomPreview(Geometry=cull_i_2, Material=ColourSwatch(SwatchColor=RGBA(133, 133, 133, 248)))
preview_12 = CustomPreview(Geometry=item_6, Material=ColourSwatch(SwatchColor=RGBA(0, 0, 0, 160)))

bead_height_2 = Data(bead_height)

# ----
# Direction 2
# ROBOT
# SYSTEM
# ROBOT
# SIMULATION
bead_height_3 = Data(bead_height_2)

bead_height_4 = Data(bead_height_3)
printing_targets = Plane(ddm_planes_4)

bbox_3 = BoundingBox(Content=flatten(printing_targets), Plane=PlaneXY(0, 0, 0), UnionBox=True)  # -> Box, Box_2

center_7 = Center(Geometry=bbox_3.Box)  # -> Center, Dimension
scale_2 = Scale(Geometry=bbox_3.Box, Center=center_7.Center, Factor=1.4)  # -> Geometry, Transform

dds_domain = Python3Script(Box=scale_2.Geometry, voxel_size=Slider(2, range=0.1..2))  # -> out, Domain; inputs Box: Box
# ---------- dds_domain: Python ----------
# venv: dds
# DDS Domain Box
# Inputs: Box, voxel_size
# Outputs: Domain
#
# - Box is a Rhino box or any object with a bounding box.
# - DDS domains are axis-aligned dense voxel grids; rotated Rhino boxes are
#   converted through their world-axis bounding box.
# - voxel_size is in the active Rhino model units. The GH helper records this
#   as millimeters internally, but it does not convert units.
# - Bounds are expanded upward to whole voxels, so Domain.max_corner may be
#   slightly larger than the input box.
# - Runtime cost scales with grid_shape[0] * grid_shape[1] * grid_shape[2].

from dds.gh_helpers.components import make_domain_from_box

Domain = None
PreviewBox = None

try:
    Domain, PreviewBox = make_domain_from_box(Box, voxel_size)
    print("Domain:", Domain.grid_shape, "voxels")
except Exception as exc:
    print("Domain creation failed:", repr(exc))
# ---------- end dds_domain ----------

dds_profile = Python3Script(width=Slider(28, range=0..100), height=bead_height_4)  # -> out, Profile; inputs width: Double, height: Double
# ---------- dds_profile: Python ----------
# venv: dds
# DDS Profile
# Inputs: width, height
# Outputs: Profile
#
# - width and height use the same units as the Domain and Target coordinates.
# - Profile describes the nominal bead cross-section used by all deposits wired
#   to it.
# - Targets are top/nozzle-referenced. The GH helpers do not expose
#   center-reference conversion.

from dds.gh_helpers.components import make_bead_profile

Profile = None

try:
    Profile = make_bead_profile(width, height)
    print("Profile:", Profile.width, "x", Profile.height)
except Exception as exc:
    print("Profile creation failed:", repr(exc))
# ---------- end dds_profile ----------

dds_point_deposit = Python3Script(Target=flatten(printing_targets), Profile=flatten(dds_profile.Profile))  # -> out, Deposit
# ---------- dds_point_deposit: Python ----------
# venv: dds
# DDS Point Deposit
# Inputs: Target, Profile
# Outputs: Deposit
#
# - Target can be a DDS target, Rhino plane/frame, or Rhino point.
# - If Target is a point, world +Z is used as its normal.
# - The deposit represents one bead centered below the top/nozzle-referenced
#   target according to Profile.height.

from dds.gh_helpers.components import make_point_deposit

Deposit = None

try:
    Deposit = make_point_deposit(Target, Profile)
    print("PointDeposit created")
except Exception as exc:
    print("Point deposit failed:", repr(exc))
# ---------- end dds_point_deposit ----------
dds_simulate = Python3Script(Domain=dds_domain.Domain, Deposits=dds_point_deposit.Deposit, run=Toggle(True), reset=button)  # -> out, Result; inputs Deposits: list
# ---------- dds_simulate: Python ----------
# venv: dds
# DDS Simulate
# Inputs: Domain, Deposits, run, reset, include_coverage
# Outputs: Result
#
# - Deposits should use List Access and may receive one or many deposit objects.
# - run gates the expensive dense-field computation. Keep it False while
#   editing sliders, then set True when you want a result.
# - reset clears the optional sticky result cache used by dds.gh_helpers.
# - include_coverage=True computes an additive overlap diagnostic. Keep it
#   False for normal mesh preview.
# - threshold is fixed to 0.5 in this template for a simpler GH UI.
# - The output Result is immutable; recomputing does not append duplicate
#   deposits.

from dds.gh_helpers.components import run_simulation

Result = None

try:
    Result = run_simulation(
        Domain,
        Deposits,
        run=run,
        reset=reset,
        threshold=0.5,
    )
    if Result is None:
        print("Simulation ready. Set run=True to compute.")
    else:
        print("Simulation deposits:", len(Result.deposits))
except Exception as exc:
    print("Simulation failed:", repr(exc))
# ---------- end dds_simulate ----------
dds_mesh = Python3Script(Result=dds_simulate.Result)  # -> out, Mesh
# ---------- dds_mesh: Python ----------
# venv: dds
# DDS Mesh
# Inputs: Result, threshold, step_size
# Outputs: Mesh
#
# - Mesh extraction runs marching cubes on Result.implicit_field.
# - This requires scikit-image in Rhino's Python environment.
# - threshold defaults to the Result threshold when empty.
# - step_size=1 gives best quality. Larger values, such as 2 or 3, are faster
#   preview meshes.
# - Grasshopper/Rhino handles display; DDS does not import PyVista or PySide.

from dds.gh_helpers.components import make_mesh

Mesh = None

try:
    if Result is None:
        print("No Result input.")
    else:
        Mesh = make_mesh(
            Result,
            threshold=None,
            step_size=1,
        )
        print("Mesh created")
except Exception as exc:
    print("Mesh extraction failed:", repr(exc))
# ---------- end dds_mesh ----------
mjoin = MeshJoin(Meshes=flatten(dds_mesh.Mesh))

preview_13 = CustomPreview(Geometry=mjoin, Material=ColourSwatch(SwatchColor=RGBA(145, 127, 118, 163)))

flip = FlipMatrix(Data=graft_list_by_same_value_2)

# ---- group: GRAFT BY Z
geo_8 = Geometry(flatten(flip))
deconstruct_3 = Deconstruct(Point=geo_8)  # -> XComponent, YComponent, ZComponent
graft_list_by_same_value_3 = GraftListBySameValue(list=geo_8, number=flatten(deconstruct_3.XComponent))

# ----
flip_2 = FlipMatrix(Data=graft_list_by_same_value_3)
ddm_planes_6 = Plane(flip_2)

# ----
# DDS
# LOADING
ddm_planes_7 = Plane(flatten(ddm_planes_6))  # disabled

# ----
# INPUT
# GEOMETRY
ddm_planes_8 = Plane(flatten(ddm_planes_7))  # disabled

createtarget_5 = CreateTarget(Plane=ddm_planes_8, Motion=list_4, Tool=tool_2.Tool, Speed=number_slider_13, Frame=frame_4, IsCartesian=True)  # disabled
createtarget_6 = CreateTarget(
    Plane=ddm_planes_8,
    Motion=list_4,
    Tool=tool_2.Tool,
    Speed=number_slider_13,
    Command=wait_2,
    Frame=frame_4,
    IsCartesian=True)  # disabled
weave_2 = Weave(Pattern=[0, 1], Stream0=createtarget_5, Stream1=createtarget_6, NullGaps=False)  # disabled
panel_27 = Panel(createtarget_5)  # disabled
merge_4 = Merge(Data1=createtarget_2, Data2=weave_2, Data3=createtarget_2)  # disabled
program_2 = CreateProgram(Name=panel_21, RobotSystem=loadrobot_2, Targets=merge_4, StepSize=number_slider_15)  # -> Program, Code, Duration, Warnings, Errors; disabled
sim_2 = ProgramSimulation(Program=program_2.Program, Time=data_2, Normalized=True)  # -> SystemMeshes, JointRotations, Plane, Index, Time, Program, Errors; disabled

# ----
# ROBOT
# SIMULATION
panel_28 = Panel(program_2.Warnings)  # disabled
panel_29 = Panel(program_2.Errors)  # disabled

ddm_planes_9 = Plane(ddm_planes_8)  # disabled

py3_2 = Python3Script(planes=flatten(ddm_planes_9), include_approach=toggle, save_file=button_3, file_path=concat_5)  # -> yaml_line_out, count_out, status_out; inputs planes: list of Plane; disabled; same code as py3
# YAML
# EXPORTER
# YAML
# EXPORTER
panel_30 = Panel(py3_2.yaml_line_out)  # disabled

deplane_3 = DeconstructPlane(Plane=ddm_planes_8)  # -> Origin, XAxis, YAxis, ZAxis; disabled
multiplication_5 = Multiplication(A=deplane_3.YAxis, B=number_slider_32)  # disabled
multiplication_6 = Multiplication(A=deplane_3.ZAxis, B=number_slider_32)  # disabled
multiplication_7 = Multiplication(A=deplane_3.XAxis, B=number_slider_32)  # disabled
vdisex_4 = VectorDisplayEx(Point=deplane_3.Origin, Vector=multiplication_6, Colour=swatch_13, Width=2)  # disabled
vdisex_5 = VectorDisplayEx(Point=deplane_3.Origin, Vector=multiplication_7, Colour=swatch_12, Width=2)  # disabled
vdisex_6 = VectorDisplayEx(Point=deplane_3.Origin, Vector=multiplication_5, Colour=swatch_14, Width=2)  # disabled

item_7 = ListItem(List=sim_2.SystemMeshes, Index=number_slider_29, Wrap=True)  # disabled
cull_i_3 = CullIndex(List=sim_2.SystemMeshes, Indices=number_slider_29, Wrap=True)  # disabled
trail_2 = SimpleTrail(Program=sim_2.Program, Length=number_slider_30, MechanicalGroup=0)  # disabled
previewlw_6 = CustomPreviewLineweights(Geometry=trail_2, Shader=swatch_5, Thickness=number_slider_31, Absolute=False)  # disabled
preview_14 = CustomPreview(Geometry=cull_i_3, Material=swatch_11)  # disabled
preview_15 = CustomPreview(Geometry=item_7, Material=swatch_6)  # disabled

tstat = TreeStatistics(Tree=ddm_planes_6)  # -> Paths, Length, Count
multiplication_8 = Multiplication(A=tstat.Count, B=addition_2, C=number_slider_7)
dup = DuplicateData(Data=reverse(data_3), Number=multiplication_8, Order=True)
bead_height_5 = Data(dup)

# ----
# Direction 1
# ROBOT
# SYSTEM
bead_height_6 = Data(bead_height_5)  # disabled

bead_height_7 = Data(bead_height_6)  # disabled
printing_targets_2 = Plane(ddm_planes_8)  # disabled

bbox_4 = BoundingBox(Content=flatten(printing_targets_2), Plane=PlaneXY(0, 0, 0), UnionBox=True)  # -> Box, Box_2; disabled

center_8 = Center(Geometry=bbox_4.Box)  # -> Center, Dimension; disabled
scale_3 = Scale(Geometry=bbox_4.Box, Center=center_8.Center, Factor=1.2)  # -> Geometry, Transform; disabled

dds_domain_2 = Python3Script(Box=scale_3.Geometry, voxel_size=number_slider_17)  # -> out, Domain; inputs Box: Box; disabled; same code as dds_domain

dds_profile_2 = Python3Script(width=number_slider_16, height=bead_height_7)  # -> out, Profile; inputs width: Double, height: Double; disabled; same code as dds_profile

dds_point_deposit_2 = Python3Script(Target=flatten(printing_targets_2), Profile=flatten(dds_profile_2.Profile))  # -> out, Deposit; disabled; same code as dds_point_deposit
dds_simulate_2 = Python3Script(Domain=dds_domain_2.Domain, Deposits=dds_point_deposit_2.Deposit, run=toggle_2, reset=button_4)  # -> out, Result; inputs Deposits: list; disabled; same code as dds_simulate
dds_mesh_2 = Python3Script(Result=dds_simulate_2.Result)  # -> out, Mesh; disabled; same code as dds_mesh
mjoin_2 = MeshJoin(Meshes=flatten(dds_mesh_2.Mesh))  # disabled

preview_16 = CustomPreview(Geometry=mjoin_2, Material=swatch_15)  # disabled

# ==== cluster GraftListBySameValue
number = ClusterInput()
number_2 = Number(number)
list = ClusterInput()

# ---- group: Groupe by layers using sets
create_set = CreateSet(List=number_2)  # -> Set, Map
sort_list = SortList(Keys=create_set.Set)  # -> Keys, ValuesValuesA
member_index = MemberIndex(Set=number_2, Member=sort_list.Keys)  # -> Index, Count
list_item = ListItem(List=list, Index=member_index.Index, Wrap=True)
group = Group(Objects=list_item)  # -> flatten(Group)

# ---- group: Sorted by layer
ungroup = Ungroup(Group=graft(group))  # -> simplify(Objects)

# ----
objects = ClusterOutput(ungroup)
