# Grasshopper definition G05_A02_beads_hgt.gh (Grasshopper 1.0.8)
# plug-ins: Heteroptera, Robots, MeshEdit Components, Pufferfish, Human, Bifocals, MetaHopper

# ----
# GEOMETRY
# TO
# FIT TO MESH
# Mesh
# Location
panel = Panel("C:\Users\efrot\OneDrive\Desktop\uni\courses\experimental architecture\")

# ----
# CLICK TO EXPORT YAML
# DIRECTORY
# FOLDER
# FILENAME
panel_2 = Panel("C:\Users\efrot\OneDrive\Desktop\uni\courses\experimental architecture\")

# ----
# DDS
# LOADING
# ROBOT
# SYSTEM
list = RobotsLibrary({"UR3e", "UR5e", "UR10e", "UR16e", "UR3", "UR5", "UR10", "UR20", "UR30"}, selected="UR20", Type=0)
loadrobot = LoadRobotSystem(Name=list, Base=PlaneXY(0, 0, 0))

ram_extruder = Mesh(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)
extruder_tcp = Plane(Plane(origin=(475.2540852, 0, 80.95937734), x=(0, -1, 0), y=(0, 0, 1)))

# ----
# Mesh
# Location
panel_3 = Panel("250")
neg = Negative(Value=panel_3)
neg_2 = Negative(Value="250")
concat = Concatenate(FragmentA=neg, FragmentB=" to ", FragmentC=panel_3)
concat_2 = Concatenate(FragmentA=neg_2, FragmentB=" to ", FragmentC="200")

# ----
# YAML
# EXPORT
panel_4 = Panel("G05_hgt_12.yaml")
button = Button()

rotate = Rotate(Geometry=ram_extruder, Angle=-1.570796327, Plane=PlaneXY(0, 0, 0))  # -> Geometry, Transform
tool = CreateTool(Name="DefaultGHTool", TCP=extruder_tcp, Weight=0, Mesh=rotate.Geometry)  # -> Tool, TCP

# ----
# CLICK ME TO SIMULATE
button_2 = Button()

# ----
# CLICK ME TO LOAD DDS
button_3 = Button()

wiredisplay = ControlWireDisplay(WireDisplay=2, AllObjects_Object=[table_center, rectangle_5, panel_10, panel_11, move_16, Z_11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])

crv = Curve(<curve referenced from the Rhino model>)
Z = UnitZ(Factor=Slider(100, range=0..1000))
move = Move(Motion=Z)  # -> Geometry, Transform
center = Center(Geometry=move.Geometry)  # -> Center, Dimension
scale_nu = ScaleNU(Geometry=move.Geometry, Plane=center.Center, ScaleX=Slider(1, range=0..1), ScaleY=Slider(0.6, range=0..1), ScaleZ=1)  # -> Geometry, Transform
Y = UnitY(Factor=Slider(32, range=0..100))
move_2 = Move(Geometry=scale_nu.Geometry, Motion=Y)  # -> Geometry, Transform
move_3 = Move(Geometry=move_2.Geometry, Motion=Z)  # -> Geometry, Transform
center_2 = Center(Geometry=move_3.Geometry)  # -> Center, Dimension
scale_nu_2 = ScaleNU(
    Geometry=move_3.Geometry,
    Plane=center_2.Center,
    ScaleX=Slider(0.8, range=0..1),
    ScaleY=Slider(0.1, range=0..1),
    ScaleZ=1)  # -> Geometry, Transform
Y_2 = UnitY(Factor=Slider(45, range=0..100))
neg_3 = Negative(Value=Y_2)
move_4 = Move(Geometry=scale_nu_2.Geometry, Motion=neg_3)  # -> Geometry, Transform
loft = Loft(
    Curves=[move_2.Geometry, move_4.Geometry],
    Options={Adjust=False, Closed=False, LoftEnds=0, LoftSimp=0, LoftType=0, Rebuild=10, Refit=0.01})  # disabled

pt = Point(Point(575.0524213, 950.5693585, 0))
Z_2 = UnitZ(Factor=Slider(0, range=0..100))
sph = Sphere(Base=pt, Radius=Slider(220, range=0..1000))
move_5 = Move(Geometry=pt, Motion=Z_2)  # -> Geometry, Transform
rectangle = Rectangle(Plane=move_5.Geometry, XSize="-500 to 500", YSize="-500 to 500", Radius=0)  # -> Rectangle, Length
panel_5 = Panel("""500
-500""")
split = SplitBrep(Brep=sph, Cutter=rectangle.Rectangle)
X = UnitX(Factor=panel_5)
item = ListItem(List=split, Index=0, Wrap=True)
move_6 = Move(Geometry=pt, Motion=X)  # -> Geometry, Transform
pline = PolyLine(Vertices=move_6.Geometry, Closed=False)
number_slider = Slider(147, range=0..1000)
number_slider_2 = Slider(99, range=0..100)
panel_6 = Panel("""20
-20""")
neg_4 = Negative(Value=number_slider)
rotate_2 = Rotate(Geometry=pline, Angle=degrees(panel_6), Plane=pt)  # -> Geometry, Transform
merge = Merge(Data1=number_slider, Data2=neg_4)
panel_7 = Panel("""60
-60""")
Y_3 = UnitY(Factor=merge)
move_7 = Move(Geometry=graft(rotate_2.Geometry), Motion=graft(Y_3))  # -> Geometry, Transform
Z_3 = UnitZ(Factor=Slider(300, range=0..1000))
extr = Extrude(Base=flatten(move_7.Geometry), Direction=Z_3)
item_2 = ListItem(List=extr, Index=0, Wrap=True)  # -> Item, Item1
split_2 = SplitBrep(Brep=item, Cutter=item_2.Item)
item_3 = ListItem(List=flatten(split_2), Index=0, Wrap=True)
split_3 = SplitBrep(Brep=item_3, Cutter=item_2.Item1)
item_4 = ListItem(List=flatten(split_3), Index=Slider(1, range=0..1), Wrap=True)
geo = Geometry(item_4)
scale_nu_3 = ScaleNU(Geometry=geo, Plane=simplify(pt), ScaleX=Slider(0.6, range=0..1), ScaleY=Slider(0.4, range=0..1), ScaleZ=1)  # -> Geometry, Transform

crv_2 = Curve(<curve referenced from the Rhino model>)
Z_4 = UnitZ(Factor=Slider(100, range=0..1000))
move_8 = Move(Geometry=crv_2, Motion=Z_4)  # -> Geometry, Transform
center_3 = Center(Geometry=move_8.Geometry)  # -> Center, Dimension
scale_nu_4 = ScaleNU(Geometry=move_8.Geometry, Plane=center_3.Center, ScaleX=Slider(1, range=0..1), ScaleY=Slider(0.6, range=0..1), ScaleZ=1)  # -> Geometry, Transform
Y_4 = UnitY(Factor=Slider(32, range=0..100))
move_9 = Move(Geometry=scale_nu_4.Geometry, Motion=Y_4)  # -> Geometry, Transform
move_10 = Move(Geometry=move_9.Geometry, Motion=Z_4)  # -> Geometry, Transform
center_4 = Center(Geometry=move_10.Geometry)  # -> Center, Dimension
scale_nu_5 = ScaleNU(
    Geometry=move_10.Geometry,
    Plane=center_4.Center,
    ScaleX=Slider(0.8, range=0..1),
    ScaleY=Slider(0.1, range=0..1),
    ScaleZ=1)  # -> Geometry, Transform
Y_5 = UnitY(Factor=Slider(45, range=0..100))
neg_5 = Negative(Value=Y_5)
move_11 = Move(Geometry=scale_nu_5.Geometry, Motion=neg_5)  # -> Geometry, Transform
loft_2 = Loft(
    Curves=[crv_2, move_9.Geometry, move_11.Geometry],
    Options={Adjust=False, Closed=False, LoftEnds=0, LoftSimp=0, LoftType=0, Rebuild=10, Refit=0.01})  # disabled

# ----
# Mesh Processing
concat_3 = Concatenate(FragmentA=panel, FragmentB="tsdf_surface_mesh.stl")
_3dm = Import3DM(File=concat_3, Layer="*", Name="*")
area = MeshArea(Mesh=_3dm)  # -> Area, Centroid
sort = SortList(Keys=area.Area, ValuesA=_3dm)  # -> Keys, reverse(ValuesA)
item_5 = ListItem(List=sort.ValuesA, Index=0, Wrap=True)
mesh = Mesh(item_5)
scale = Scale(Geometry=mesh, Center=Point(0, 0, 0), Factor=Slider(1000, range=0..1000))  # -> Geometry, Transform
rotate_3 = Rotate(Geometry=scale.Geometry, Angle=degrees(Slider(180, range=0..1000)), Plane=PlaneXY(0, 0, 0))  # -> Geometry, Transform
center_5 = Center(Geometry=rotate_3.Geometry)  # -> Center, Dimension
rectangle_2 = Rectangle(Plane=center_5.Center, XSize=concat_2, YSize=concat, Radius=0)  # -> Rectangle, Length
Z_5 = UnitZ(Factor=Slider(20, range=0..100))
move_12 = Move(Geometry=rectangle_2.Rectangle, Motion=Z_5)  # -> Geometry, Transform
panel_8 = Panel("""-20
20""")
Z_6 = UnitZ(Factor=Slider(100, range=0..100))
extr_2 = Extrude(Base=move_12.Geometry, Direction=expr("x*-1", Z_6))
Z_7 = UnitZ(Factor=panel_8)
mesh_2 = Mesh(extr_2)
move_13 = Move(Geometry=center_5.Center, Motion=Z_7)  # -> Geometry, Transform
msplit = MeshSplit(Mesh=rotate_3.Geometry, Splitters=mesh_2)
pline_2 = PolyLine(Vertices=move_13.Geometry, Closed=False)
mcx = MeshCurve(Mesh=msplit, Curve=pline_2)  # -> Points, Faces
null = NullItem(Item=mcx.Points)  # -> flatten(NullFlags), InvalidFlags, Description
dispatch = Dispatch(List=msplit, DispatchPattern=null.NullFlags)  # -> ListA, ListB
geo_2 = Geometry(dispatch.ListB)
medges = MeshEdges(Mesh=geo_2)  # -> NakedEdges, InteriorEdges, NonManifoldEdges
end = EndPoints(Curve=medges.InteriorEdges)  # -> Start, End
patch = Patch(Points=end.Start, Spans=Slider(20, range=0..100), Flexibility=Slider(0.1, range=0..0.1), Trim=True)
srf = Surface(patch)
surface_generator = Python3Script(
    base_surface=srf,
    divU=panel_3,
    divV="250",
    lift=Slider(0, range=0..100),
    make_mesh=Toggle(True),
    mesh_mode=Slider(1, range=0..100),
    run=Toggle(True))  # -> out_points, out_grid, out_mesh, out_uv, dbg; inputs base_surface: Surface, divU: Int32, divV: Int32, lift: Double
# ---------- surface_generator: Python ----------
import Rhino.Geometry as rg
import rhinoscriptsyntax as rs
import Rhino
import System

# Inputs expected in GH:
#   base_surface (trimmed BrepFace or Brep or guid)
#   divU (int)
#   divV (int)
#   lift (float)           # optional, along face normal
#   make_mesh (bool)       # optional
#   mesh_mode (str/int)    # "tri" or "quad" (or 0=tri, 1=quad)
#   run (bool)

# ------------------------------------------------------------
# Helpers: unwrap/coerce BrepFace
# ------------------------------------------------------------
def coerce_face(x):
    g = getattr(x, "Geometry", x)

    try:
        if isinstance(g, System.Guid):
            g = rs.coercebrep(g) or rs.coercesurface(g)
    except:
        pass

    if g is None:
        return None

    if isinstance(g, rg.Brep):
        if g.Faces.Count == 0:
            return None
        return g.Faces[0]

    if isinstance(g, rg.BrepFace):
        return g

    if isinstance(g, rg.Surface):
        b = rg.Brep.CreateFromSurface(g)
        if b and b.Faces.Count > 0:
            return b.Faces[0]
        return None

    return None

def parse_mesh_mode(m):
    # returns "tri" or "quad"
    if m is None:
        return "tri"
    if isinstance(m, str):
        s = m.strip().lower()
        if "quad" in s:
            return "quad"
        return "tri"
    try:
        return "quad" if int(m) == 1 else "tri"
    except:
        return "tri"

# ------------------------------------------------------------
# Main
# ------------------------------------------------------------
out_points = []
out_grid = []
out_mesh = None
out_uv = []
dbg = ""

if not run:
    dbg = "run is False"
else:
    face = coerce_face(base_surface)
    if face is None:
        dbg = "ERROR: base_surface is not a BrepFace/Brep/Surface (or could not be coerced)"
    else:
        divU = int(divU)
        divV = int(divV)

        uCount = max(2, divU + 1)
        vCount = max(2, divV + 1)

        dom_u = face.Domain(0)
        dom_v = face.Domain(1)
        du = float(dom_u.T1 - dom_u.T0)
        dv = float(dom_v.T1 - dom_v.T0)

        if du == 0.0 or dv == 0.0:
            dbg = "ERROR: face domain is degenerate"
        else:
            mode = parse_mesh_mode(mesh_mode)

            vidx = [[-1 for _ in range(uCount)] for __ in range(vCount)]
            out_grid = [[None for _ in range(uCount)] for __ in range(vCount)]

            lift_val = float(lift) if lift is not None else 0.0
            keep_count = 0
            skip_count = 0

            mesh = rg.Mesh() if make_mesh else None

            # Sample only the trimmed region using IsPointOnFace(u,v)
            for v_i in range(vCount):
                vn = float(v_i) / float(vCount - 1) if vCount > 1 else 0.0
                v = dom_v.T0 + vn * dv

                for u_i in range(uCount):
                    un = float(u_i) / float(uCount - 1) if uCount > 1 else 0.0
                    u = dom_u.T0 + un * du

                    rel = face.IsPointOnFace(u, v)
                    if rel == rg.PointFaceRelation.Exterior:
                        skip_count += 1
                        continue

                    p = face.PointAt(u, v)

                    if lift_val != 0.0:
                        n = face.NormalAt(u, v)
                        if n.IsTiny():
                            n = rg.Vector3d(0, 0, 1)
                        else:
                            n.Unitize()
                        p = rg.Point3d(p.X + n.X * lift_val,
                                      p.Y + n.Y * lift_val,
                                      p.Z + n.Z * lift_val)

                    out_grid[v_i][u_i] = p
                    out_points.append(p)
                    out_uv.append(rg.Point2d(u, v))
                    keep_count += 1

                    if mesh is not None:
                        vid = mesh.Vertices.Add(p)
                        vidx[v_i][u_i] = vid

            # Build faces from valid grid cells only
            face_count = 0
            if mesh is not None:
                for v_i in range(vCount - 1):
                    for u_i in range(uCount - 1):
                        a = vidx[v_i][u_i]
                        b = vidx[v_i][u_i + 1]
                        c = vidx[v_i + 1][u_i + 1]
                        d = vidx[v_i + 1][u_i]

                        # Require all corners inside trims
                        if a < 0 or b < 0 or c < 0 or d < 0:
                            continue

                        if mode == "quad":
                            # one quad per cell
                            mesh.Faces.AddFace(a, b, c, d)
                            face_count += 1
                        else:
                            # two triangles per cell
                            mesh.Faces.AddFace(a, b, c)
                            mesh.Faces.AddFace(a, c, d)
                            face_count += 2

                if mesh.Faces.Count > 0:
                    mesh.Normals.ComputeNormals()
                    mesh.Compact()
                    out_mesh = mesh

            dbg = "OK: grid {}x{} kept:{} skipped:{} mesh_mode:{} mesh_faces:{}".format(
                uCount, vCount, keep_count, skip_count, mode, (out_mesh.Faces.Count if out_mesh else 0)
            )
# ---------- end surface_generator ----------
msplit_2 = MeshSplit(Mesh=surface_generator.out_mesh, Splitters=mesh_2)
mcx_2 = MeshCurve(Mesh=msplit_2, Curve=pline_2)  # -> Points, Faces
null_2 = NullItem(Item=mcx_2.Points)  # -> flatten(NullFlags), InvalidFlags, Description
dispatch_2 = Dispatch(List=msplit_2, DispatchPattern=null_2.NullFlags)  # -> ListA, ListB

Z_8 = UnitZ(Factor=Slider(100, range=0..1000))
move_14 = Move(Geometry=crv, Motion=Z_8)  # -> Geometry, Transform
curve = Curve(<curve referenced from the Rhino model>)
curve_2 = Curve(<curve referenced from the Rhino model>)
loft_3 = Loft(
    Curves=[curve, move_2.Geometry, move_4.Geometry],
    Options={Adjust=False, Closed=False, LoftEnds=0, LoftSimp=0, LoftType=0, Rebuild=10, Refit=0.01})  # disabled
loft_4 = Loft(
    Curves=[crv_2, curve_2, move_9.Geometry, move_11.Geometry],
    Options={Adjust=False, Closed=False, LoftEnds=0, LoftSimp=0, LoftType=0, Rebuild=10, Refit=0.01})

panel_9 = Panel("C:\Users\efrot\OneDrive\Desktop\uni\courses\experimental architecture\3DP-DDS-main\3DP-DDS-main\src\")
dds_setup = Python3Script(run=button_3, package_path=panel_9)  # -> out, DDSPath; inputs run: Boolean, package_path: String
# ---------- dds_setup: Python ----------
# venv: dds
# DDS Setup
# Inputs: package_path, run
# Outputs: DDSPath
# r: numpy==2.0.2, scipy==1.13.1, scikit-image==0.24.0
#
# - package_path points at the repository `src` folder, not the repository root.
# - Use a Button for run. The path is stored in scriptcontext.sticky so it
#   remains available after the button releases.
# - This only points Rhino Python at DDS source code. It does not install
#   runtime dependencies such as numpy, scipy, or scikit-image.
# - DDSPath should resolve to `.../3DP-DDS/src/dds/__init__.py`; any other path
#   means Rhino is importing a different DDS copy.

import sys
import scriptcontext as sc

KEY = "dds.gh_helpers.source_path"

if run and package_path:
    sc.sticky[KEY] = package_path

DDS_SRC = sc.sticky.get(KEY, package_path)

if DDS_SRC and DDS_SRC not in sys.path:
    sys.path.insert(0, DDS_SRC)

OK = False
DDSPath = None

if DDS_SRC:
    try:
        import dds
        import dds.gh_helpers

        DDSPath = dds.__file__
        if bool(DDSPath and DDSPath.startswith(DDS_SRC)):
            print("DDS loaded from:", DDSPath)
        else:
            print("DDS imported from unexpected path:", DDSPath)
    except Exception as exc:
        DDSPath = None
        print("DDS setup failed:", repr(exc))
else:
    print("Press run with package_path set to the DDS src folder.")
# ---------- end dds_setup ----------

input_geometry = Geometry(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)

# ----
# Grid
# Dimensions
number_slider_3 = Slider(32, range=0..1000)
# Bead Height
# Exploration
number_slider_4 = Slider(88, range=0..1000)

# ----
# Grid
# Division
number_slider_5 = Slider(1, range=0..10)

# ----
# Starting Bead
# Height
# Added
# Height
number_slider_6 = Slider(4, range=0..10)

# ----
# Added
# Layers
number_slider_7 = Slider(2, range=0..10)

panel_10 = Panel("-1000 to 1000")
panel_11 = Panel("-400 to 400")
panel_12 = Panel("-300 to 300")
panel_13 = Panel("-200 to 200")
controlbox_center = Point(Point(-1243.688337, -331.9089097, -930))
table_center = Point(Point(-5.611449167, 956.0239308, -930))

smoothed_mesh = Geometry(dispatch_2.ListB)
addition = Addition(A=number_slider_5, B="1")

medges_2 = MeshEdges(Mesh=smoothed_mesh)  # -> NakedEdges, InteriorEdges, NonManifoldEdges
number_slider_8 = Slider(5, range=0..10)
swatch = ColourSwatch(SwatchColor=RGB(88, 191, 44))
swatch_2 = ColourSwatch(SwatchColor=RGBA(27, 59, 13, 80))
swatch_3 = ColourSwatch(SwatchColor=RGBA(51, 51, 51, 176))
preview = CustomPreview(Geometry=rotate_3.Geometry, Material=swatch_3)
preview_2 = CustomPreview(Geometry=smoothed_mesh, Material=swatch_2)
previewlw = CustomPreviewLineweights(Geometry=medges_2.NakedEdges, Shader=swatch, Thickness=number_slider_8, Absolute=False)

# ----
# ROBOT
# SIMULATION
# WARNINGS
# ERRORS
number_slider_9 = Slider(0.9826, range=0..1)

panel_14 = Panel("base")
# ROBOT
# SIMULATION
panel_15 = Panel("-1.5708,-1.5708,2.0944,0,1.5708,pi")
number_slider_10 = Slider(5, range=0..10)
frame = CreateFrame(Plane=PlaneXY(0, 0, 0), CoupledMechanicalGroup=-1, CoupledMechanism=-1, Name=panel_14)
frame_2 = CreateFrame(Plane=PlaneXY(0, 0, 0), CoupledMechanicalGroup=-1, CoupledMechanism=-1)
number_slider_11 = Slider(100, range=0..1000)
number_slider_12 = Slider(75, range=0..1000)
list_2 = ValueList({"Joint", "Linear"}, selected="Linear")
wait = Wait(Time=number_slider_10)
panel_16 = Panel("0")
createtarget = CreateTarget(Joints=panel_15, Tool=tool.Tool, Speed=number_slider_12, Zone=panel_16, Frame=frame, IsCartesian=False)
number_slider_13 = Slider(1, range=0..10)
panel_17 = Panel("UR_20")
data = Data(number_slider_9)

folder_name = Data(panel_2)
file_name = Data(panel_4)
toggle = BooleanToggle(False)
concat_4 = Concatenate(FragmentA=folder_name, FragmentB=file_name)

number_slider_14 = Slider(30, range=0..100)

number_slider_15 = Slider(2, range=0.1..2)

neg_6 = Negative(Value=number_slider_4)
dom = ConstructDomain(DomainStart=neg_6, DomainEnd=number_slider_3)
addition_2 = Addition(A=number_slider_4, B=number_slider_3)
rectangle_3 = Rectangle(Plane=PlaneXY(0, 0, 0), XSize=dom, YSize=dom, Radius=0)  # -> Rectangle, Length
series = Series(Start=Slider(8, range=0..100), Step=number_slider_6, Count=addition)  # -> reverse(Series)
division = Division(A=addition_2, B=number_slider_5)
grid = GridInRectangle(Rectangle=rectangle_3.Rectangle, Size=division)  # -> Points, U, V
bbox = BoundingBox(Content=flatten(grid.Points), Plane=PlaneXY(0, 0, 0), UnionBox=True)  # -> Box, Box_2
center_6 = Center(Geometry=bbox.Box, referenceAll=2)  # -> Center, Dimension
multiplication = Multiplication(A=series, B=number_slider_7)
pt_2 = ConstructPoint(XCoordinate=0, YCoordinate=0, ZCoordinate=0)
Z_9 = UnitZ(Factor=series)
Z_10 = UnitZ(Factor=multiplication)
move_15 = Move(Geometry=pt_2, Motion=Z_10)  # -> Geometry, Transform
ln = Line(StartPoint=pt_2, EndPoint=move_15.Geometry)  # -> graft(Line)
len = Length(Curve=ln)
division_2 = Division(A=len, B=number_slider_7)

panel_18 = Panel(series)

# ---- group: GRAFT BY Z
geo_3 = Geometry(flatten(grid.Points))
deconstruct = Deconstruct(Point=geo_3)  # -> XComponent, YComponent, ZComponent
graft_list_by_same_value = GraftListBySameValue(list=geo_3, number=flatten(deconstruct.XComponent))

# ----
rectangle_4 = Rectangle(Plane=controlbox_center, XSize=panel_12, YSize=panel_13, Radius=0)  # -> Rectangle, Length
rectangle_5 = Rectangle(Plane=table_center, XSize=panel_10, YSize=panel_11, Radius=0)  # -> Rectangle, Length
number_slider_16 = Slider(720, range=0..1000)
number_slider_17 = Slider(600, range=0..1000)
Z_11 = UnitZ(Factor=number_slider_16)
move_16 = Move(Geometry=rectangle_5.Rectangle, Motion=Z_11)  # -> Geometry, Transform
Z_12 = UnitZ(Factor=number_slider_17)
number_slider_18 = Slider(0.92, range=0..1)
number_slider_19 = Slider(0.8, range=0..1)
srf_2 = Surface(rectangle_4.Rectangle)
number_slider_20 = Slider(20, range=0..100)
extr_3 = Extrude(Base=srf_2, Direction=Z_12)
Z_13 = UnitZ(Factor=number_slider_20)
srf_3 = Surface(move_16.Geometry)
scale_nu_6 = ScaleNU(Geometry=move_16.Geometry, Plane=table_center, ScaleX=number_slider_18, ScaleY=number_slider_19, ScaleZ=1)  # -> Geometry, Transform
extr_4 = Extrude(Base=srf_3, Direction=Z_13)
disc = Discontinuity(Curve=scale_nu_6.Geometry, Level=1)  # -> Points, Parameters
number_slider_21 = Slider(15, range=0..100)
cir = Circle(Plane=disc.Points, Radius=number_slider_21)
srf_4 = Surface(cir)
subtraction = Subtraction(A=number_slider_16, B=number_slider_20)
Z_14 = UnitZ(Factor=expr("-X", subtraction))
extr_5 = Extrude(Base=srf_4, Direction=Z_14)
number_slider_22 = Slider(3, range=0..10)
swatch_4 = ColourSwatch(SwatchColor=RGB(54, 54, 54))
swatch_5 = ColourSwatch(SwatchColor=RGB(255, 255, 255))
swatch_6 = ColourSwatch(SwatchColor=RGBA(166, 166, 166, 160))
swatch_7 = ColourSwatch(SwatchColor=RGB(59, 59, 59))

table_surface = Geometry(extr_4)
control_box = Geometry(extr_3)
robot_base = Geometry(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)
table_legs = Geometry(extr_5)

edges = BrepEdges(Brep=[robot_base, table_surface, table_legs, control_box])  # -> Naked, Interior, NonManifold
# WORKCELL
# VISUALIZATION
previewlw_2 = CustomPreviewLineweights(Geometry=edges.Interior, Shader=swatch_4, Thickness=number_slider_22, Absolute=False)
preview_3 = CustomPreview(Geometry=robot_base, Material=swatch_5)
preview_4 = CustomPreview(Geometry=[table_surface, control_box], Material=swatch_6)
preview_5 = CustomPreview(Geometry=table_legs, Material=swatch_7)

# ----
# Orient Object
# To Table Mesh
facen = FaceNormals(Mesh=smoothed_mesh)  # -> Centers, Normals
avr = Average(Input=facen.Normals)
avr_2 = Average(Input=facen.Centers)
bbox_2 = BoundingBox(Content=flatten(input_geometry), Plane=PlaneXY(0, 0, 0), UnionBox=True)  # -> Box, Box_2
pl = PlaneNormal(Origin=avr_2, ZAxis=avr)
prot = RotatePlane(Plane=pl, Angle=degrees(Slider(90, range=0..100)))
center_7 = Center(Geometry=bbox_2.Box, referenceAll=2)  # -> Center, Dimension
flippln = FlipPlane(Plane=prot, FlipX=invert(False), FlipY=invert(False), FlipZ=invert(True))  # -> Flipped, R

flip_plane = FlipPlane(Plane=flippln.Flipped, ReverseX=False, ReverseY=False, SwapAxes=True)

orient = Orient(Geometry=input_geometry, Source=center_7.Center, Target=flip_plane)  # -> Geometry, Transform

oriented_geometry = Geometry(orient.Geometry)

orient_2 = Orient(Geometry=graft_list_by_same_value, Source=center_6.Center, Target=flippln.Flipped)  # -> Geometry, Transform
geo_4 = Geometry(orient_2.Geometry)

toggle_2 = BooleanToggle(True)

# ----
# ROBOT
# VISUALIZATION
number_slider_23 = Slider(7, range=0..10)
number_slider_24 = Slider(1518, range=0..10000)
number_slider_25 = Slider(5, range=0..10)
swatch_8 = ColourSwatch(SwatchColor=RGBA(44, 159, 191, 248))
swatch_9 = ColourSwatch(SwatchColor=RGBA(133, 133, 133, 248))
swatch_10 = ColourSwatch(SwatchColor=RGBA(0, 0, 0, 160))

# ----
# TARGETS
# VISUALIZATION
number_slider_26 = Slider(25, range=0..100)
swatch_11 = ColourSwatch(SwatchColor=RGB(255, 0, 0))
swatch_12 = ColourSwatch(SwatchColor=RGB(0, 68, 255))
swatch_13 = ColourSwatch(SwatchColor=RGB(0, 255, 4))

swatch_14 = ColourSwatch(SwatchColor=RGB(145, 127, 118))

move_17 = Move(Geometry=simplify(geo_4), Motion=graft(Z_9))  # -> Geometry, Transform
orient_3 = Orient(Geometry=ln, Source=PlaneXY(0, 0, 0), Target=move_17.Geometry)  # -> Geometry, Transform
midpt = CurveMiddle(Curve=orient_3.Geometry)
divide = DivideCurve(Curve=orient_3.Geometry, Count=number_slider_7, Kinks=False)  # -> simplify(Points), Tangents, Parameters
tag = TextTag3D(Location=midpt, Text=division_2, Size=Slider(25, range=0..100), Justification=7)

# ---- group: GRAFT BY Z
geo_5 = Geometry(flatten(divide.Points))
deconstruct_2 = Deconstruct(Point=geo_5)  # -> XComponent, YComponent, ZComponent
graft_list_by_same_value_2 = GraftListBySameValue(list=geo_5, number=flatten(deconstruct_2.YComponent))

# ----
# Bead Generation
deplane = DeconstructPlane(Plane=flippln.Flipped)  # -> Origin, XAxis, YAxis, ZAxis
contour = Contour(Shape=oriented_geometry, Point=flippln.Flipped, Direction=deplane.ZAxis, Distance=Slider(14, range=0..100))
# 1/2 bead width as they are alternating
number_slider_27 = Slider(9, range=0..100)
bead_height = Data(Slider(16, range=0..100))

cull_i = CullIndex(List=flatten(contour), Indices=Slider(0, range=0..100), Wrap=True)

dispatch_3 = Dispatch(List=flatten(cull_i), DispatchPattern=[True, False])  # -> ListA, ListB
divdist = DivideDistance(Curve=dispatch_3.ListA, Distance=number_slider_27)  # -> Points, Tangents, Parameters
divdist_2 = DivideDistance(Curve=dispatch_3.ListB, Distance=number_slider_27)  # -> Points, Tangents, Parameters
dispatch_4 = Dispatch(List=divdist.Points, DispatchPattern=[True, False])  # -> ListA, ListB
dispatch_5 = Dispatch(List=divdist_2.Points, DispatchPattern=[True, False])  # -> ListA, ListB
geo_6 = Geometry(dispatch_4.ListA)
geo_7 = Geometry(dispatch_5.ListB)
merge_2 = Merge(Data1=geo_6, Data2=geo_7)

ddm_planes = Plane(merge_2)

flip = FlipMatrix(Data=graft_list_by_same_value_2)

# ---- group: GRAFT BY Z
geo_8 = Geometry(flatten(flip))
deconstruct_3 = Deconstruct(Point=geo_8)  # -> XComponent, YComponent, ZComponent
graft_list_by_same_value_3 = GraftListBySameValue(list=geo_8, number=flatten(deconstruct_3.XComponent))

# ----
flip_2 = FlipMatrix(Data=graft_list_by_same_value_3)
ddm_planes_2 = Plane(flip_2)

tstat = TreeStatistics(Tree=ddm_planes_2)  # -> Paths, Length, Count
dup = DuplicateData(Data=reverse(flatten(division_2)), Number=tstat.Count, Order=True)
bead_height_2 = Data(dup)

ddm_planes_3 = Plane(flatten(ddm_planes_2))

# ----
# INPUT
# GEOMETRY
ddm_planes_4 = Plane(flatten(ddm_planes_3))

createtarget_2 = CreateTarget(Plane=ddm_planes_4, Motion=list_2, Tool=tool.Tool, Speed=number_slider_11, Frame=frame_2, IsCartesian=True)
createtarget_3 = CreateTarget(Plane=ddm_planes_4, Motion=list_2, Tool=tool.Tool, Speed=number_slider_11, Command=wait, Frame=frame_2, IsCartesian=True)
weave = Weave(Pattern=[0, 1], Stream0=createtarget_2, Stream1=createtarget_3, NullGaps=False)
panel_19 = Panel(createtarget_2)
merge_3 = Merge(Data1=createtarget, Data2=weave, Data3=createtarget)
program = CreateProgram(Name=panel_17, RobotSystem=loadrobot, Targets=merge_3, StepSize=number_slider_13)  # -> Program, Code, Duration, Warnings, Errors
sim = ProgramSimulation(Program=program.Program, Time=data, Normalized=True)  # -> SystemMeshes, JointRotations, Plane, Index, Time, Program, Errors

panel_20 = Panel(program.Warnings)
panel_21 = Panel(program.Errors)

ddm_planes_5 = Plane(ddm_planes_4)

py3 = Python3Script(planes=flatten(ddm_planes_5), include_approach=toggle, save_file=button, file_path=concat_4)  # -> yaml_line_out, count_out, status_out; inputs planes: list of Plane
# ---------- py3: Python ----------
"""
Planes → YAML writer (index + "O(...) Z(...)" line)

Rhino 8 (GH Python) compatible.

Inputs:
    planes     : list of Rhino.Geometry.Plane
    save_file  : boolean toggle
    file_path  : string

Outputs:
    yaml_out       : full YAML as string
    yaml_line_out  : YAML as list of lines
    count_out      : number of planes exported
    status_out     : export status message
"""

import Rhino
import os

# -----------------------------
# Units conversion (doc → meters)
# -----------------------------
doc = Rhino.RhinoDoc.ActiveDoc
doc_units = doc.ModelUnitSystem if doc else Rhino.UnitSystem.Millimeters
to_m = Rhino.RhinoMath.UnitScale(doc_units, Rhino.UnitSystem.Meters)

def _unitize(v):
    vv = Rhino.Geometry.Vector3d(v)
    vv.Unitize()
    return vv

def _fmt2(x):
    return "%.2f" % float(x)

def _origin_str_mm(o):
    # Your example numbers look like mm, so keep ORIGIN in document units (likely mm).
    # If you actually want meters, multiply by to_m here.
    return "O(%s,%s,%s)" % (_fmt2(o.X), _fmt2(o.Y), _fmt2(o.Z))

def _zaxis_str(z):
    zu = _unitize(z)
    return "Z(%s,%s,%s)" % (_fmt2(zu.X), _fmt2(zu.Y), _fmt2(zu.Z))

def make_yaml(planes_in):
    lines = ["targets:"]
    valid_planes = [p for p in planes_in if p is not None]

    for i, pl in enumerate(valid_planes):
        o = pl.Origin
        z = pl.ZAxis

        lines.append("  - index: %d" % i)
        lines.append("    plane: \"%s %s\"" % (_origin_str_mm(o), _zaxis_str(z)))

    return lines, len(valid_planes)

# -----------------------------
# Run safely
# -----------------------------
yaml_line_out, yaml_out, count_out, status_out = [], "", 0, ""

try:
    if planes is None:
        planes = []
    if file_path is None:
        file_path = ""

    yaml_line_out, count_out = make_yaml(list(planes))
    yaml_out = "\n".join(yaml_line_out)

    if count_out == 0:
        status_out = "No valid planes exported."
    else:
        status_out = "Prepared %d plane(s)." % count_out

    if save_file and file_path:
        try:
            folder = os.path.dirname(file_path)
            if folder and not os.path.exists(folder):
                os.makedirs(folder)
            with open(file_path, "w", encoding="utf-8") as f:
                f.write(yaml_out)
            status_out = "Saved YAML to: %s" % file_path
        except TypeError:
            with open(file_path, "w") as f:
                f.write(yaml_out)
            status_out = "Saved YAML to: %s" % file_path
        except Exception as e:
            status_out = "Could not save file: %s" % e

except Exception as e:
    yaml_line_out = ["# ERROR: %s" % e]
    yaml_out = "# ERROR: %s" % e
    count_out = 0
    status_out = "ERROR: %s" % e
# ---------- end py3 ----------
# YAML
# EXPORTER
# YAML
# EXPORTER
panel_22 = Panel(py3.yaml_line_out)

deplane_2 = DeconstructPlane(Plane=ddm_planes_4)  # -> Origin, XAxis, YAxis, ZAxis
multiplication_2 = Multiplication(A=deplane_2.YAxis, B=number_slider_26)
multiplication_3 = Multiplication(A=deplane_2.ZAxis, B=number_slider_26)
multiplication_4 = Multiplication(A=deplane_2.XAxis, B=number_slider_26)
vdisex = VectorDisplayEx(Point=deplane_2.Origin, Vector=multiplication_3, Colour=swatch_12, Width=2)
vdisex_2 = VectorDisplayEx(Point=deplane_2.Origin, Vector=multiplication_4, Colour=swatch_11, Width=2)
vdisex_3 = VectorDisplayEx(Point=deplane_2.Origin, Vector=multiplication_2, Colour=swatch_13, Width=2)

item_6 = ListItem(List=sim.SystemMeshes, Index=number_slider_23, Wrap=True)
cull_i_2 = CullIndex(List=sim.SystemMeshes, Indices=number_slider_23, Wrap=True)
trail = SimpleTrail(Program=sim.Program, Length=number_slider_24, MechanicalGroup=0)
previewlw_3 = CustomPreviewLineweights(Geometry=trail, Shader=swatch_8, Thickness=number_slider_25, Absolute=False)
preview_6 = CustomPreview(Geometry=cull_i_2, Material=swatch_9)
preview_7 = CustomPreview(Geometry=item_6, Material=swatch_10)

bead_height_3 = Data(bead_height_2)

printing_targets = Plane(ddm_planes_4)
bead_height_4 = Data(bead_height_3)

bbox_3 = BoundingBox(Content=flatten(printing_targets), Plane=PlaneXY(0, 0, 0), UnionBox=True)  # -> Box, Box_2

dds_domain = Python3Script(Box=bbox_3.Box, voxel_size=number_slider_15)  # -> out, Domain; inputs Box: Box
# ---------- dds_domain: Python ----------
# venv: dds
# DDS Domain Box
# Inputs: Box, voxel_size
# Outputs: Domain
#
# - Box is a Rhino box or any object with a bounding box.
# - DDS domains are axis-aligned dense voxel grids; rotated Rhino boxes are
#   converted through their world-axis bounding box.
# - voxel_size is in the active Rhino model units. The GH helper records this
#   as millimeters internally, but it does not convert units.
# - Bounds are expanded upward to whole voxels, so Domain.max_corner may be
#   slightly larger than the input box.
# - Runtime cost scales with grid_shape[0] * grid_shape[1] * grid_shape[2].

from dds.gh_helpers.components import make_domain_from_box

Domain = None
PreviewBox = None

try:
    Domain, PreviewBox = make_domain_from_box(Box, voxel_size)
    print("Domain:", Domain.grid_shape, "voxels")
except Exception as exc:
    print("Domain creation failed:", repr(exc))
# ---------- end dds_domain ----------

dds_profile = Python3Script(width=number_slider_14, height=bead_height_4)  # -> out, Profile; inputs width: Double, height: Double
# ---------- dds_profile: Python ----------
# venv: dds
# DDS Profile
# Inputs: width, height
# Outputs: Profile
#
# - width and height use the same units as the Domain and Target coordinates.
# - Profile describes the nominal bead cross-section used by all deposits wired
#   to it.
# - Targets are top/nozzle-referenced. The GH helpers do not expose
#   center-reference conversion.

from dds.gh_helpers.components import make_bead_profile

Profile = None

try:
    Profile = make_bead_profile(width, height)
    print("Profile:", Profile.width, "x", Profile.height)
except Exception as exc:
    print("Profile creation failed:", repr(exc))
# ---------- end dds_profile ----------

dds_point_deposit = Python3Script(Target=flatten(printing_targets), Profile=flatten(dds_profile.Profile))  # -> out, Deposit
# ---------- dds_point_deposit: Python ----------
# venv: dds
# DDS Point Deposit
# Inputs: Target, Profile
# Outputs: Deposit
#
# - Target can be a DDS target, Rhino plane/frame, or Rhino point.
# - If Target is a point, world +Z is used as its normal.
# - The deposit represents one bead centered below the top/nozzle-referenced
#   target according to Profile.height.

from dds.gh_helpers.components import make_point_deposit

Deposit = None

try:
    Deposit = make_point_deposit(Target, Profile)
    print("PointDeposit created")
except Exception as exc:
    print("Point deposit failed:", repr(exc))
# ---------- end dds_point_deposit ----------
dds_simulate = Python3Script(Domain=dds_domain.Domain, Deposits=dds_point_deposit.Deposit, run=toggle_2, reset=button_2)  # -> out, Result; inputs Deposits: list
# ---------- dds_simulate: Python ----------
# venv: dds
# DDS Simulate
# Inputs: Domain, Deposits, run, reset, include_coverage
# Outputs: Result
#
# - Deposits should use List Access and may receive one or many deposit objects.
# - run gates the expensive dense-field computation. Keep it False while
#   editing sliders, then set True when you want a result.
# - reset clears the optional sticky result cache used by dds.gh_helpers.
# - include_coverage=True computes an additive overlap diagnostic. Keep it
#   False for normal mesh preview.
# - threshold is fixed to 0.5 in this template for a simpler GH UI.
# - The output Result is immutable; recomputing does not append duplicate
#   deposits.

from dds.gh_helpers.components import run_simulation

Result = None

try:
    Result = run_simulation(
        Domain,
        Deposits,
        run=run,
        reset=reset,
        threshold=0.5,
    )
    if Result is None:
        print("Simulation ready. Set run=True to compute.")
    else:
        print("Simulation deposits:", len(Result.deposits))
except Exception as exc:
    print("Simulation failed:", repr(exc))
# ---------- end dds_simulate ----------
dds_mesh = Python3Script(Result=dds_simulate.Result)  # -> out, Mesh
# ---------- dds_mesh: Python ----------
# venv: dds
# DDS Mesh
# Inputs: Result, threshold, step_size
# Outputs: Mesh
#
# - Mesh extraction runs marching cubes on Result.implicit_field.
# - This requires scikit-image in Rhino's Python environment.
# - threshold defaults to the Result threshold when empty.
# - step_size=1 gives best quality. Larger values, such as 2 or 3, are faster
#   preview meshes.
# - Grasshopper/Rhino handles display; DDS does not import PyVista or PySide.

from dds.gh_helpers.components import make_mesh

Mesh = None

try:
    if Result is None:
        print("No Result input.")
    else:
        Mesh = make_mesh(
            Result,
            threshold=None,
            step_size=1,
        )
        print("Mesh created")
except Exception as exc:
    print("Mesh extraction failed:", repr(exc))
# ---------- end dds_mesh ----------
mjoin = MeshJoin(Meshes=flatten(dds_mesh.Mesh))

preview_8 = CustomPreview(Geometry=mjoin, Material=swatch_14)

# ==== cluster GraftListBySameValue
number = ClusterInput()
number_2 = Number(number)
list = ClusterInput()

# ---- group: Groupe by layers using sets
create_set = CreateSet(List=number_2)  # -> Set, Map
sort_list = SortList(Keys=create_set.Set)  # -> Keys, ValuesValuesA
member_index = MemberIndex(Set=number_2, Member=sort_list.Keys)  # -> Index, Count
list_item = ListItem(List=list, Index=member_index.Index, Wrap=True)
group = Group(Objects=list_item)  # -> flatten(Group)

# ---- group: Sorted by layer
ungroup = Ungroup(Group=graft(group))  # -> simplify(Objects)

# ----
objects = ClusterOutput(ungroup)
